# Grasshopper definition Grasshopper main.gh (Grasshopper 1.0.7)
# plug-ins: EleFront, LunchBox

bake_all = BakeAllElefront(False)
stirrup_visibility = Slider(0.6, range=0..1)
attributes = DefineObjectAttributes(Layer=graft("b_Text"))
attributes_2 = DefineObjectAttributes(Layer=graft("b_Dimension Text"))
attributes_3 = DefineObjectAttributes(Layer=graft("b_Rebar"))
attributes_4 = DefineObjectAttributes(Layer=graft("b_Centerline"))
attributes_5 = DefineObjectAttributes(Layer=graft("b_Back lines"))
attributes_6 = DefineObjectAttributes(Layer=graft("b_Dimension shear"))
attributes_7 = DefineObjectAttributes(Layer=graft("b_Rebar shear"))

number_slider = Slider(1, range=0..10)

# ----
# INPUT DATA
number_slider_2 = Slider(6, range=0..15)
move = Slider(4, range=0..100)
toggle = BooleanToggle(True)
number_slider_3 = Slider(7, range=0..10)
cluster = Cluster_5(worksheet=number_slider_2)
sec_beam_width = Slider(230, range=0..1000)
sec_beam_depth = Slider(425, range=0..1000)
column_depth = Slider(400, range=0..1000)
column_rise = Slider(500, range=0..1000)
section_rise = Slider(500, range=0..1000)
number_slider_4 = Slider(90, range=0..100)
sec_beam = BooleanToggle(False)
mid_rebar = BooleanToggle(False)
addition = Addition(A=number_slider_3, B=cluster)
python = GhPythonScript(
    SB_toggle=sec_beam,
    SB_Width=sec_beam_width,
    SB_Depth=sec_beam_depth,
    Section_rise=section_rise,
    Col_rise=column_rise,
    Col_depth=column_depth,
    Mid_rebar_toggle=mid_rebar,
    Dimension_offset=Slider(400, range=0..1000),
    Text_size=number_slider_4)  # -> fixed_data
# ---------- python: Python ----------
fixed_data= []

fixed_data.append(SB_toggle)
fixed_data.append(SB_Width)
fixed_data.append(SB_Depth)
fixed_data.append(Section_rise)
fixed_data.append(Col_rise)
fixed_data.append(Col_depth)
fixed_data.append(Mid_rebar_toggle)
fixed_data.append(Dimension_offset)
fixed_data.append(Text_size)
# ---------- end python ----------
cluster_2 = Cluster_4(read=toggle, worksheet=number_slider_2, rowstart=number_slider_3, rowend=addition)  # -> x, a, span_no, relay

multiplication = Multiplication(A=number_slider_2, B=Slider(4, range=0..10))

multiplication_2 = Multiplication(A=multiplication, B=10000)
num = Number(multiplication_2)

excelread = ExcelReaderLEGACY(
    ReadToggle=toggle,
    Worksheet=number_slider_2,
    Column=Slider(4, range=0..10),
    RowStart=number_slider,
    RowEnd=number_slider)  # -> Exceptions, simplify(flatten(ExcelData))
split = TextSplit(Text=excelread.ExcelData, Separators="d")
item = ListItem(List=split, Index=0, Wrap=True)  # -> Item, flatten(Item1)
pt = ConstructPoint(XCoordinate=num, YCoordinate=0, ZCoordinate=Slider(1500, range=0..10000))
panel = Panel(item.Item1)
xz = XZPlane(Origin=pt)
join = TextJoin(Text=["BEAM REINFORCEMENT DETAILS AT GRID ", panel])
text = DefineTextObject(
    Text=join,
    Plane=xz,
    DimensionStyle="Dim100",
    Justification="TopLeft",
    Size=Slider(400, range=0..1000),
    OutputType="Text")

panel_2 = Panel(addition)

# ----
# SECTIONS
python_2 = GhPythonScript(x=cluster_2.relay)  # -> out, section_name, simplify(graft(section_data)); inputs x: tree
# ---------- python_2: Python ----------
import ghpythonlib.treehelpers as th

a_list = th.tree_to_list(x,lambda data:data)

#print a_list[0]

section_data = []
section_name =[]


for item in a_list:
    if item[31] not in section_name:
        section_name.append(item[31])
        section_data.append(item)

#print section_name
#print section_data
section_data =section_data
section_name =section_name
# ---------- end python_2 ----------
slab_extension = Slider(75, range=0..100)
clear_cover = Slider(25, range=0..100)
max_row = Slider(3, range=0..10)
slab_depth = Slider(125, range=0..1000)
cross_section = CrossSection(
    clear_cover=clear_cover,
    slab_depth_mm=slab_depth,
    slab_extension_mm=slab_extension,
    mid_rebar_boolean=mid_rebar,
    max_row=max_row,
    section_distance=Slider(1500, range=0..10000),
    data=python_2.section_data,
    move=num,
    text_size=number_slider_4)  # -> long_rebar_2, long_rebar, texts_2, dimensions_2, backlines_2

# ----
# END PARTS
fixed_data = GhPythonScript(fixed_data=python)  # -> Col_rise, Col_depth, Text_size; inputs fixed_data: list
# ---------- fixed_data: Python ----------
SB_toggle = fixed_data[0] 
SB_Width= fixed_data[1] 
SB_Depth= fixed_data[2] 
Section_rise=fixed_data[3] 
Col_rise=fixed_data[4] 
Col_depth=fixed_data[5] 
Mid_rebar_toggle=fixed_data[6] 
Dimension_offset=fixed_data[7] 
Text_size=fixed_data[8]
# ---------- end fixed_data ----------
neg = Negative(Value=fixed_data.Col_rise)
end_col_1 = EndCol1(
    beam_depth_6=mid_rebar,
    beam_depth_5=fixed_data.Col_depth,
    rise=neg,
    beam_depth_3=fixed_data.Text_size,
    beam_depth=cluster_2.a,
    beam_depth_2=num,
    beam_depth_4=stirrup_visibility)  # -> long_rebar, back_line_2, center_liner_2, shear_rebar, text_3, dimension_2

# ----
# MIDDLE PARTS
fixed_data_2 = GhPythonScript(fixed_data=python)  # -> SB_toggle, SB_Width, SB_Depth, Section_rise, Col_rise, Col_depth, Mid_rebar_toggle, Dimension_offset, Text_size; inputs fixed_data: list; same code as fixed_data
middle_part = MiddlePart(
    bool=fixed_data_2.SB_toggle,
    sec_beam_width=fixed_data_2.SB_Width,
    sec_beam_depth=fixed_data_2.SB_Depth,
    section_rise=fixed_data_2.Section_rise,
    column_rise=fixed_data_2.Col_rise,
    col_depth_1=fixed_data_2.Col_depth,
    boolean_toggle_mid_bar=fixed_data_2.Mid_rebar_toggle,
    dimension_offset=fixed_data_2.Dimension_offset,
    text_size=fixed_data_2.Text_size,
    strp_visiblity=stirrup_visibility,
    span_no=cluster_2.span_no,
    data=cluster_2.x,
    move=num)  # -> shear_bars_2, longitudinal_bars_2, backlines_2, centerlines_2, text_11, dimensions_shear_2, dimensions_2

geo = Geometry([middle_part.longitudinal_bars_2, end_col_1.long_rebar])
geo_2 = Geometry([end_col_1.shear_rebar, middle_part.shear_bars_2, cross_section.long_rebar_2, cross_section.long_rebar])
geo_3 = Geometry([cross_section.backlines_2, middle_part.backlines_2, end_col_1.back_line_2])
geo_4 = Geometry([cross_section.texts_2, end_col_1.text_3, middle_part.text_11, text])
geo_5 = Geometry([cross_section.dimensions_2, end_col_1.dimension_2, middle_part.dimensions_2])
geo_6 = Geometry([middle_part.centerlines_2, end_col_1.center_liner_2])
geo_7 = Geometry(middle_part.dimensions_shear_2)
bake = BakeObjects(Geometry=graft(geo_5), Attributes=attributes_2, Bake=False)
bake_2 = BakeObjects(Geometry=graft(geo_4), Attributes=attributes, Bake=False)
bake_3 = BakeObjects(Geometry=graft(geo_6), Attributes=attributes_4, Bake=False)
bake_4 = BakeObjects(Geometry=graft(geo_3), Attributes=attributes_5, Bake=False)
bake_5 = BakeObjects(Geometry=graft(geo), Attributes=attributes_3, Bake=False)
bake_6 = BakeObjects(Geometry=graft(geo_7), Attributes=attributes_6, Bake=False)
bake_7 = BakeObjects(Geometry=graft(geo_2), Attributes=attributes_7, Bake=False)

# ==== cluster MiddlePart
data = ClusterInput()
move = ClusterInput()
data_2 = Data(data)
python = GhPythonScript(x=data_2, move=move)  # -> Origin_pt, Mid_section, End_section, Beam_depth, Span_length, T_A_mn1, T_A_md1, T_A_mn2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
# ---------- python: Python ----------
import rhinoscriptsyntax as rs

#print x[0]
#print x[1]

Mid_section = x[1][31]
End_section = x[0][31]
Beam_depth = x[0][4]
Span_length = x[0][3]
T_A_mn1 = x[0][12]
T_A_md1 = x[0][13]
T_A_mn2 = x[0][14]
T_A_md2 = x[0][15]
T_L_en1 = x[0][16]
T_L_ed1 = x[0][17]
T_L_en2 = x[0][18]
T_L_ed2 = x[0][19]
#print T_L_ed1

E_slno = x[0][28]
E_sd = x[0][29]
E_ss = x[0][30]
M_sd = x[1][29]
M_ss = x[1][30]

B_A_mn1 = x[0][20]
B_A_md1 = x[0][21]
B_A_mn2 = x[0][22]
B_A_md2 = x[0][23]
B_L_en1 = x[0][24]
B_L_ed1 = x[0][25]
B_L_en2 = x[0][26]
B_L_ed2 = x[0][27]

# ORIGIN POINT DETERMINATION AND SPAN NO. DETERMINATION
x1 = move+ float(x[0][36])
y1=0
z1= float(x[0][37])

Origin_pt = rs.AddPoint(x1,y1,z1)
print x1
print z1

#SPAN NO
# ---------- end python ----------
mid_section = Text(python.Mid_section)
end_section = Text(python.End_section)
strp_visiblity = ClusterInput()
text_size = ClusterInput()
span_no = ClusterInput()
dimension_offset = ClusterInput()
boolean_toggle_mid_bar = ClusterInput()
col_depth_1 = ClusterInput()
column_rise = ClusterInput()
section_rise = ClusterInput()
section_rise_2 = Number(section_rise)
pt = Point(python.Origin_pt)
python_2 = GhPythonScript(x=python.B_A_mn1, y=python.B_A_md1, z=python.B_A_mn2, u=python.B_A_md2)  # -> out, tmain; inputs z: Int32, u: Int32
# ---------- python_2: Python ----------
if z is not None and z!=0 :
    tmain = str(x)+ "-T" +str(y)+ " + " +str(z)+ "-T" +str(u)+ " TH" 
else:
    tmain =  str(x)+ "-T" +str(y)+ " TH"
# ---------- end python_2 ----------
python_3 = GhPythonScript(x=python.B_L_en1, y=python.B_L_ed1, z=python.B_L_en2, u=python.B_L_ed2, v=python_2.tmain)  # -> out, tmain
# ---------- python_3: Python ----------
if x is not None and  int(x) !=0:
    if z is not None and int(z) !=0 :
        tmain =   str(x)+ "-T" +str(y)+ " + " +str(z)+ "-T" +str(u)+ " EX" 
    else:
        tmain =   str(x)+ "-T" +str(y)+ " EX" 

#if x is not None and  int(x) !=0:
#    if z is not None and int(z) !=0 :
#        tmain =   v + '+' +str(x)+ "-T" +str(y)+ " + " +str(z)+ "-T" +str(u)+ " EX" 
#    else:
#        tmain =  v + '+ ' + str(x)+ "-T" +str(y)+ " EX" 
#else:
#    tmain = v
#
# ---------- end python_3 ----------

# ---- group: Input : Longitudinal Bar Details
# LONGITUDINAL BAR DETAILS
python_4 = GhPythonScript(x=python.T_A_mn1, y=python.T_A_md1, z=python.T_A_mn2, u=python.T_A_md2)  # -> out, tmain; inputs z: Int32, u: Int32; same code as python_2
python_5 = GhPythonScript(x=python.T_L_en1, y=python.T_L_ed1, z=python.T_L_en2, u=python.T_L_ed2, v=python_4.tmain)  # -> out, tmain
# ---------- python_5: Python ----------
if x is not None and  int(x) !=0:
    if z is not None and int(z) !=0 :
        tmain =  str(x)+ "-T" +str(y)+ " + " +str(z)+ "-T" +str(u)+ " EX" 
    else:
        tmain =   str(x)+ "-T" +str(y)+ " EX" 


#if x is not None and  int(x) !=0:
#    if z is not None and int(z) !=0 :
#        tmain =   v + '+' +str(x)+ "-T" +str(y)+ " + " +str(z)+ "-T" +str(u)+ " EX" 
#    else:
#        tmain =  v + '+ ' + str(x)+ "-T" +str(y)+ " EX" 
#else:
#    tmain = v
# ---------- end python_5 ----------
rebar_top_main = Panel(python_4.tmain)
rebar_top_extra = Panel(python_5.tmain)
rebar_bottom_main = Panel(python_2.tmain)
rebar_bottom_extra = Panel(python_3.tmain)

# ----
multiplication = Multiplication(BEAMDEPTH=python.Beam_depth, B=2)

# ---- group: Input : Shear Bar Details
# SHEAR BAR DETAILS
sbar_mid_distance = Number(python.M_ss)
sbar_2_distance = Number(python.E_ss)
sbar_1_distance = Number(python.E_ss)
python_6 = GhPythonScript(x=python.E_slno, y=python.E_sd, z=sbar_1_distance)  # -> out, tmain; inputs x: list, y: list, z: list
# ---------- python_6: Python ----------
tmain = str(int(x[0])) + "L-T" + str(int(y[0]))+ "@" + str(int(z[0]))
# ---------- end python_6 ----------
python_7 = GhPythonScript(x=python.E_slno, y=python.E_sd, z=sbar_mid_distance)  # -> out, tmain
# ---------- python_7: Python ----------
tmain = str(int(x)) + "L-T" + str(int(y))+ "@" + str(int(z))
# ---------- end python_7 ----------
python_8 = GhPythonScript(x=python.E_slno, y=python.E_sd, z=sbar_2_distance)  # -> out, tmain; same code as python_7
shear_rebar_mid = Panel(python_7.tmain)
shear_rebar_right = Panel(python_8.tmain)
shear_rebar_left = Panel([python_6.tmain, multiplication])

# ----
# SECTION NAME
span_length = Number(python.Span_length)
multiplication_2 = Multiplication(A=col_depth_1, B=Slider(1.4, range=0..10))
subtraction = Subtraction(A=python.Span_length, B=multiplication_2)
pt_2 = Point(pt)
X = UnitX(Factor=span_length)
X_2 = UnitX(Factor=col_depth_1)
origin_pt = Point(pt)
origin_pt_2 = Point(pt)
division = Division(A=X, B=2)
X_3 = UnitX(Factor=subtraction)
multiplication_3 = Multiplication(A=X_2, B=Slider(0.9, range=0..1))
move_2 = Move(Geometry=pt_2, Motion=division)  # -> Geometry, Transform
move_3 = Move(Geometry=origin_pt, Motion=multiplication_3)  # -> Geometry, Transform
move_4 = Move(Geometry=origin_pt_2, Motion=X_3)  # -> Geometry, Transform
pt_3 = Point(move_2.Geometry)
pt_4 = Point(move_4.Geometry)
pt_5 = Point([move_3.Geometry, pt_4])

python_9 = GhPythonScript(x=multiplication)  # -> out, a; inputs x: list
# ---------- python_9: Python ----------
a =x [0]
# ---------- end python_9 ----------

# ---- group: Back Col Lines 2
beam_depth = Number(python.Beam_depth)
expression = Expression(x=beam_depth, Expression="-x")
col_depth = Number(col_depth_1)
X_4 = UnitX(SpanLength=python.Span_length)
expression_2 = Expression(x=col_depth, Expression="-x/2")
vec = VectorXYZ(XComponent=python.Span_length, YComponent=0, ZComponent=expression)  # -> Vector, Length
addition = Addition(SpanLength=python.Span_length, B=expression_2)
move_5 = Move(OriginPt=python.Origin_pt, Motion=X_4)  # -> Geometry, Transform
move_6 = Move(OriginPt=python.Origin_pt, Motion=vec.Vector)  # -> Geometry, Transform
neg = Negative(ColRise=column_rise)
X_5 = UnitX(Factor=addition)
reverse = BooleanToggle(True)
vec_2 = VectorXYZ(XComponent=addition, YComponent=0, ZComponent=expression)  # -> Vector, Length
move_7 = Move(OriginPt=python.Origin_pt, Motion=vec_2.Vector)  # -> Geometry, Transform
move_8 = Move(OriginPt=python.Origin_pt, Motion=X_5)  # -> Geometry, Transform
back_col = BackCol(origin_point=move_7.Geometry, col_width=col_depth_1, boolean=reverse, F=neg, beam_depth=python.Beam_depth)  # -> back_line, centerline

# ---- group: Back Col Lines
beam_depth_2 = Number(python.Beam_depth)
col_depth_2 = Number(col_depth_1)
expression_3 = Expression(x=beam_depth_2, Expression="-x")
expression_4 = Expression(x=col_depth_2, Expression="x/2")
neg_2 = Negative(ColRise=column_rise)
Z = UnitZ(Factor=expression_3)
move_9 = Move(OriginPt=python.Origin_pt, Motion=Z)  # -> Geometry, Transform
X_6 = UnitX(Factor=expression_4)
reverse_2 = BooleanToggle(False)
vec_3 = VectorXYZ(XComponent=expression_4, YComponent=0, ZComponent=expression_3)  # -> Vector, Length
move_10 = Move(OriginPt=python.Origin_pt, Motion=X_6)  # -> Geometry, Transform
# BEAM/COLUMN LINES
move_11 = Move(OriginPt=python.Origin_pt, Motion=vec_3.Vector)  # -> Geometry, Transform
back_col_2 = BackCol(origin_point=move_11.Geometry, col_width=col_depth_1, boolean=reverse_2, F=neg_2, beam_depth=python.Beam_depth)  # -> back_line, centerline

# ----
section_rise_3 = Number(section_rise_2)
new_line = Panel("")
join = TextJoin(Text=[python_9.a, python_6.tmain], Join=new_line)
bool = ClusterInput()
sec_beam_depth = ClusterInput()
sec_beam_width = ClusterInput()
bool_2 = Boolean(bool)
addition_2 = Addition(SectionRise=section_rise_3, BeamDepth=python.Beam_depth)
X_7 = UnitX(Factor=Slider(300, range=0..1000))
move_12 = Move(Geometry=pt_3, Motion=X_7)  # -> Geometry, Transform
cluster = Cluster(
    pt=move_12.Geometry,
    sec_beam_width=sec_beam_width,
    sec_beam_depth=sec_beam_depth,
    main_beam_depth=python.Beam_depth,
    B=Slider(30, range=0..100),
    bar_diameter=Slider(20, range=0..100),
    G=bool_2)

Z_2 = UnitZ(Factor=addition_2)
Z_3 = UnitZ(Factor=section_rise_3)
rev = Reverse(Vector=Z_2)
move_13 = Move(Geometry=pt_5, Motion=Z_3)  # -> Geometry, Transform
move_14 = Move(Geometry=pt_5, Motion=rev)  # -> Geometry, Transform
X_8 = UnitX(Factor=Slider(100, range=0..100))
move_15 = Move(Geometry=[move_13.Geometry, move_14.Geometry], Motion=X_8)  # -> Geometry, Transform
ln = Line(StartPoint=[move_13.Geometry, move_14.Geometry], EndPoint=move_15.Geometry)
ln_2 = Line(StartPoint=move_13.Geometry, EndPoint=move_14.Geometry)

Z_4 = UnitZ(Factor=addition_2)
Z_5 = UnitZ(Factor=section_rise_3)
rev_2 = Reverse(Vector=Z_4)
move_16 = Move(Geometry=move_12.Geometry, Motion=Z_5)  # -> Geometry, Transform
move_17 = Move(Geometry=move_12.Geometry, Motion=rev_2)  # -> Geometry, Transform
X_9 = UnitX(Factor=Slider(100, range=0..100))
move_18 = Move(Geometry=[move_16.Geometry, move_17.Geometry], Motion=X_9)  # -> Geometry, Transform
ln_3 = Line(StartPoint=[move_16.Geometry, move_17.Geometry], EndPoint=move_18.Geometry)
ln_4 = Line(StartPoint=move_16.Geometry, EndPoint=move_17.Geometry)
pt_6 = Point(move_17.Geometry)
pt_7 = Point(move_16.Geometry)
vec_4 = VectorXYZ(XComponent=Slider(110, range=50..1000), YComponent=0, ZComponent=0)  # -> Vector, Length
vec_5 = VectorXYZ(XComponent=Slider(110, range=50..1000), YComponent=0, ZComponent=0)  # -> Vector, Length
move_19 = Move(Geometry=pt_6, Motion=vec_4.Vector)  # -> Geometry, Transform
move_20 = Move(Geometry=pt_7, Motion=vec_5.Vector)  # -> Geometry, Transform
xz = XZPlane(Origin=move_19.Geometry)
xz_2 = XZPlane(Origin=move_20.Geometry)
panel = Panel("B")
num = Number(text_size)
num_2 = Number(text_size)
text = DefineTextObject(Text=mid_section, Location=xz, DimensionStyle="Dim100", Justification="MiddleLeft", Size=num, OutputType="Text")
text_2 = DefineTextObject(Text=mid_section, Location=xz_2, DimensionStyle="Dim100", Justification="MiddleLeft", Size=num_2, OutputType="Text")

origin_end_down_pt = Point(move_6.Geometry)
origin_down_pt = Point(move_9.Geometry)
origin_end_pt = Point(move_5.Geometry)
origin_pt_3 = Point(python.Origin_pt)
ln_5 = Line(StartPoint=origin_pt_3, EndPoint=origin_end_pt)
ln_6 = Line(StartPoint=origin_down_pt, EndPoint=origin_end_down_pt)
top_line = Line(StartPoint=move_10.Geometry, EndPoint=move_8.Geometry)
bottom_line = Line(StartPoint=move_11.Geometry, EndPoint=move_7.Geometry)

pt_8 = Point(move_13.Geometry)
vec_6 = VectorXYZ(XComponent=Slider(110, range=50..1000), YComponent=0, ZComponent=0)  # -> Vector, Length
move_21 = Move(Geometry=pt_8, Motion=vec_6.Vector)  # -> Geometry, Transform
xz_3 = XZPlane(Origin=move_21.Geometry)
panel_3 = Panel("A")
num_3 = Number(text_size)
text_3 = DefineTextObject(Text=end_section, Location=xz_3, DimensionStyle="Dim100", Justification="MiddleLeft", Size=num_3, OutputType="Text")

pt_9 = Point(move_14.Geometry)
vec_7 = VectorXYZ(XComponent=Slider(110, range=50..1000), YComponent=0, ZComponent=0)  # -> Vector, Length
move_22 = Move(Geometry=pt_9, Motion=vec_7.Vector)  # -> Geometry, Transform
xz_4 = XZPlane(Origin=move_22.Geometry)
num_4 = Number(text_size)
text_4 = DefineTextObject(Text=end_section, Location=xz_4, DimensionStyle="Dim100", Justification="MiddleLeft", Size=num_4, OutputType="Text")

Z_6 = UnitZ(Factor=Slider(50, range=0..100))
rev_3 = Reverse(Vector=Z_6)

# ---- group: Long Rebar
# REBAR MAIN
top_rebar_cover = Slider(40, range=0..75)
Z_7 = UnitZ(Factor=top_rebar_cover)
bot_rebar = Move(Geometry=ln_6, Motion=Z_7)  # -> Geometry, Transform
Z_8 = UnitZ(Factor=top_rebar_cover)
rev_4 = Reverse(Vector=Z_8)
top_rebar = Move(Geometry=ln_5, Motion=rev_4)  # -> Geometry, Transform

# ---- group: MID REBAR LONGITUDINAL
division_2 = Division(BeamDepth=python.Beam_depth, B=2)
subtraction_2 = Subtraction(BeamDepth2=division_2, RebarCover=top_rebar_cover)
Z_9 = UnitZ(Factor=subtraction_2)
rev_5 = Reverse(Vector=Z_9)
move_23 = Move(MainRebar=top_rebar.Geometry, Motion=rev_5)  # -> Geometry, Transform
boolean_toggle_mid_bar_2 = Boolean(boolean_toggle_mid_bar)
filter = StreamFilter(Gate=boolean_toggle_mid_bar_2, Stream1=move_23.Geometry)

# ----
# ANNOTATE BARS
bottom_line_2 = Line(bottom_line)
top_line_2 = Line(top_line)

# ---- group: 2d Shear bars 1
_2_from_face = Slider(50, range=0..100)
rebar_cover = Number(top_rebar_cover)
top_line_3 = Line(top_line)
neg_3 = Negative(Value=rebar_cover)
vec_8 = VectorXYZ(XComponent=_2_from_face, YComponent=0, ZComponent=rebar_cover)  # -> Vector, Length
curvepoint = PointOnCurve(top_line_3, parameter=0)
vec_9 = VectorXYZ(XComponent=_2_from_face, YComponent=0, ZComponent=neg_3)  # -> Vector, Length
bottom_line_3 = Line(bottom_line)
curvepoint_2 = PointOnCurve(bottom_line_3, parameter=0)
# SHEAR REBARS
move_24 = Move(Geometry=curvepoint, Motion=vec_9.Vector)  # -> Geometry, Transform
move_25 = Move(Geometry=curvepoint_2, Motion=vec_8.Vector)  # -> Geometry, Transform
_2d_spacing = Slider(100, range=0..150)
ln_7 = Line(StartPoint=move_24.Geometry, EndPoint=move_25.Geometry)
vec_10 = VectorXYZ(XComponent=python.E_ss, YComponent=0, ZComponent=0)  # -> Vector, Length
python_10 = GhPythonScript(span=python.Span_length, bar_spacing=python.E_ss, beam_depth=python.Beam_depth)  # -> out, N, C_Bool; inputs span: list, bar_spacing: list, beam_depth: list
# ---------- python_10: Python ----------
#import rhinoscriptsyntax as rs
#beam_depth=2
#span=5
#print beam_depth[0]

if (2*beam_depth[0]<=span[0]/2-0.1):
    N = (beam_depth[0]*2)/bar_spacing[0] 
    C_Bool = 1
else :
    N= round((span[0]/2-0.05)/bar_spacing[0])
    C_Bool = 0

#print N
# ---------- end python_10 ----------
arrlinear = LinearArray(Geometry=ln_7, Direction=vec_10.Vector, Count=python_10.N)  # -> Geometry, Transform

# ----
relay = Relay()
relay_2 = Relay()

# ---- group: Long Bar : Bottom Extra
Z_10 = UnitZ(Factor=Slider(75, range=0..100))

# ----
span_length_2 = Number(python.Span_length)
# REBAR EXTRA
pt_10 = Point(pt)
X_10 = UnitX(Factor=span_length_2)
expression_5 = Expression(x=col_depth_1, y=span_length_2, Expression="x/2+y/4")
move_26 = Move(Geometry=pt_10, Motion=X_10)  # -> Geometry, Transform
division_3 = Division(ColDepth=col_depth_1, B=2)
X_11 = UnitX(Factor=expression_5)
X_12 = UnitX(Factor=division_3)
move_27 = Move(Geometry=pt_10, Motion=X_11)  # -> Geometry, Transform
rev_6 = Reverse(Vector=X_11)
move_28 = Move(Geometry=pt_10, Motion=X_12)  # -> Geometry, Transform
move_29 = Move(Geometry=move_26.Geometry, Motion=rev_6)  # -> Geometry, Transform
rev_7 = Reverse(Vector=X_12)
move_30 = Move(Geometry=move_27.Geometry, Motion=rev_3)  # -> Geometry, Transform
move_31 = Move(Geometry=move_29.Geometry, Motion=rev_3)  # -> Geometry, Transform
move_32 = Move(Geometry=move_26.Geometry, Motion=rev_7)  # -> Geometry, Transform
ln_8 = Line(StartPoint=pt_10, EndPoint=move_27.Geometry)
ln_9 = Line(StartPoint=move_27.Geometry, EndPoint=move_30.Geometry)
ln_10 = Line(StartPoint=move_26.Geometry, EndPoint=move_29.Geometry)
ln_11 = Line(StartPoint=move_29.Geometry, EndPoint=move_31.Geometry)
python_11 = GhPythonScript(x=flatten(python.T_L_en1))  # -> tmain
# ---------- python_11: Python ----------
if x is not None and  int(x) !=0:
    tmain = True 
else:
    tmain = False
# ---------- end python_11 ----------
join_2 = JoinCurves(Curves=[ln_9, ln_8], Preserve=False)
join_3 = JoinCurves(Curves=[ln_11, ln_10], Preserve=False)
dispatch = Dispatch(List=flatten(join_2), DispatchPattern=python_11)  # -> ListA, ListB
dispatch_2 = Dispatch(List=flatten(join_3), DispatchPattern=python_11)  # -> ListA, ListB
crv = Curve(dispatch.ListA)
crv_2 = Curve(dispatch_2.ListA)
rev_8 = Reverse(Vector=Z_10)
move_33 = Move(Geometry=[crv_2, crv], Motion=rev_8)  # -> Geometry, Transform
crv_3 = Curve(move_33.Geometry)

Z_11 = UnitZ(Factor=python.Beam_depth)
rev_9 = Reverse(Vector=Z_11)
move_34 = Move(Geometry=pt_10, Motion=rev_9)  # -> Geometry, Transform
pt_11 = Point(move_34.Geometry)
X_13 = UnitX(Factor=span_length_2)
move_35 = Move(Geometry=pt_11, Motion=X_13)  # -> Geometry, Transform
rev_10 = Reverse(Vector=X_11)
move_36 = Move(Geometry=move_35.Geometry, Motion=rev_10)  # -> Geometry, Transform
move_37 = Move(Geometry=pt_11, Motion=X_11)  # -> Geometry, Transform
move_38 = Move(Geometry=move_37.Geometry, Motion=Z_6)  # -> Geometry, Transform
move_39 = Move(Geometry=move_36.Geometry, Motion=Z_6)  # -> Geometry, Transform
python_12 = GhPythonScript(x=flatten(python.B_L_en1))  # -> tmain
# ---------- python_12: Python ----------
if x is not None and  int(x) !=0:
    tmain = True 
else:
    tmain=False
# ---------- end python_12 ----------
ln_12 = Line(StartPoint=pt_11, EndPoint=move_37.Geometry)
ln_13 = Line(StartPoint=move_37.Geometry, EndPoint=move_38.Geometry)
ln_14 = Line(StartPoint=move_36.Geometry, EndPoint=move_39.Geometry)
ln_15 = Line(StartPoint=move_35.Geometry, EndPoint=move_36.Geometry)
join_4 = JoinCurves(Curves=[ln_13, ln_12], Preserve=False)
join_5 = JoinCurves(Curves=[ln_14, ln_15], Preserve=False)
dispatch_3 = Dispatch(List=flatten(join_4), DispatchPattern=python_12)  # -> ListA, ListB
dispatch_4 = Dispatch(List=flatten(join_5), DispatchPattern=python_12)  # -> ListA, ListB
crv_4 = Curve(dispatch_4.ListA)
crv_5 = Curve(dispatch_3.ListA)
move_40 = Move(Geometry=[crv_4, crv_5], Motion=Z_10)  # -> Geometry, Transform
crv_6 = Curve(move_40.Geometry)

# ---- group: Annotate : Bottom Extra
curvepoint_3 = PointOnCurve(bottom_line_2, parameter=1)
vec_11 = VectorXYZ(XComponent=Slider(-50, range=-1000..-50), YComponent=0, ZComponent=Slider(-50, range=-1000..-50))  # -> Vector, Length
move_41 = Move(Geometry=curvepoint_3, Motion=vec_11.Vector)  # -> Geometry, Transform
xz_5 = XZPlane(Origin=move_41.Geometry)
text_5 = DefineTextObject(
    Text=rebar_bottom_extra,
    Location=xz_5,
    DimensionStyle="Dim100",
    Justification="TopRight",
    Size=text_size,
    OutputType="Text")

# ---- group: Annotate : Bottom Main
midpt = CurveMiddle(Curve=bottom_line_2)
vec_12 = VectorXYZ(XComponent=0, YComponent=0, ZComponent=Slider(-50, range=-1000..-50))  # -> Vector, Length
move_42 = Move(Geometry=midpt, Motion=vec_12.Vector)  # -> Geometry, Transform
xz_6 = XZPlane(Origin=move_42.Geometry)
text_6 = DefineTextObject(
    Text=rebar_bottom_main,
    Location=xz_6,
    DimensionStyle="Dim100",
    Justification="TopCenter",
    Size=text_size,
    OutputType="Text")

# ---- group: Annotate : Top Extra
curvepoint_4 = PointOnCurve(top_line_2, parameter=0.025)
vec_13 = VectorXYZ(XComponent=0, YComponent=0, ZComponent=Slider(50, range=50..1000))  # -> Vector, Length
move_43 = Move(Geometry=curvepoint_4, Motion=vec_13.Vector)  # -> Geometry, Transform
xz_7 = XZPlane(Origin=move_43.Geometry)
text_7 = DefineTextObject(
    Text=rebar_top_extra,
    Location=xz_7,
    DimensionStyle="Dim100",
    Justification="BottomLeft",
    Size=text_size,
    OutputType="Text")

# ---- group: Annotate : Top Main
midpt_2 = CurveMiddle(Curve=top_line_2)
vec_14 = VectorXYZ(XComponent=0, YComponent=0, ZComponent=Slider(50, range=50..1000))  # -> Vector, Length
move_44 = Move(Geometry=midpt_2, Motion=vec_14.Vector)  # -> Geometry, Transform
xz_8 = XZPlane(Origin=move_44.Geometry)
text_8 = DefineTextObject(
    Text=rebar_top_main,
    Location=xz_8,
    DimensionStyle="Dim100",
    Justification="BottomCenter",
    Size=text_size,
    OutputType="Text")

# ----
python_13 = GhPythonScript(span=python.Span_length, bar_spacing=python.E_ss, beam_depth=python.Beam_depth)  # -> out, N, C_Bool; inputs span: list, bar_spacing: list, beam_depth: list; same code as python_10

# ---- group: 2d Shear bars 2
_2_from_face_2 = Slider(50, range=0..100)
rebar_cover_2 = Number(top_rebar_cover)
neg_4 = Negative(Value=rebar_cover_2)
neg_5 = Negative(Value=_2_from_face_2)
vec_15 = VectorXYZ(XComponent=neg_5, YComponent=0, ZComponent=rebar_cover_2)  # -> Vector, Length
top_line_4 = Line(top_line)
bottom_line_4 = Line(bottom_line)
vec_16 = VectorXYZ(XComponent=neg_5, YComponent=0, ZComponent=neg_4)  # -> Vector, Length
curvepoint_5 = PointOnCurve(top_line_4, parameter=1)
curvepoint_6 = PointOnCurve(bottom_line_4, parameter=1)
move_45 = Move(Geometry=curvepoint_5, Motion=vec_16.Vector)  # -> Geometry, Transform
move_46 = Move(Geometry=curvepoint_6, Motion=vec_15.Vector)  # -> Geometry, Transform
ln_16 = Line(StartPoint=move_45.Geometry, EndPoint=move_46.Geometry)
vec_17 = VectorXYZ(XComponent=python.E_ss, YComponent=0, ZComponent=0)  # -> Vector, Length
rev_11 = Reverse(Vector=vec_17.Vector)
arrlinear_2 = LinearArray(Geometry=ln_16, Direction=rev_11, Count=python_13.N)  # -> Geometry, Transform

# ----
panel_5 = Panel("""TopCenter
MiddleCenter
BottomCenter
TopRight
MiddleRight
BottomRight
TopLeft
BottomLeft
MiddleLeft""")
multiplication_4 = Multiplication(A=strp_visiblity, B=1.2)
python_14 = GhPythonScript(x=arrlinear.Geometry, y=strp_visiblity)  # -> out, a; inputs x: list
# ---------- python_14: Python ----------
a = []
for i in range(0,len(x)):
    if i > len(x)*(1- y)/2 and i < len(x)*(1+ y)/2 :
        a.append(x[i])
# ---------- end python_14 ----------
python_15 = GhPythonScript(x=arrlinear_2.Geometry, y=strp_visiblity)  # -> out, a; inputs x: list; same code as python_14
pt_12 = Point(move_28.Geometry)

beam_depth_3 = Number(python.Beam_depth)
col_width = Number(col_depth_1)
division_4 = Division(A=col_width, B=2)
neg_6 = Negative(Value=beam_depth_3)
vec_18 = VectorXYZ(XComponent=division_4, YComponent=0, ZComponent=neg_6)  # -> Vector, Length
origin_pt_4 = Point(pt)
multiplication_5 = Multiplication(BeamDepth=beam_depth_3, B=2)
move_47 = Move(Geometry=origin_pt_4, Motion=vec_18.Vector)  # -> Geometry, Transform
X_14 = UnitX(Factor=multiplication_5)
move_48 = Move(Geometry=move_47.Geometry, Motion=X_14)  # -> Geometry, Transform
xz_9 = XZPlane(Origin=Point(0, 0, 0))
neg_7 = Negative(Value=dimension_offset)
lineardim = DefineLinearDimension(
    Point1=move_47.Geometry,
    Point2=move_48.Geometry,
    DimensionPlane=xz_9,
    Offset=neg_7,
    DimensionStyle="Dim100 mid",
    OverwriteText=join)

col_width_2 = Number(col_depth_1)
division_5 = Division(A=col_width_2, B=2)
beam_depth_4 = Number(python.Beam_depth)
neg_8 = Negative(Value=beam_depth_4)
neg_9 = Negative(Value=division_5)
vec_19 = VectorXYZ(XComponent=neg_9, YComponent=0, ZComponent=neg_8)  # -> Vector, Length
multiplication_6 = Multiplication(BeamDepth=beam_depth_4, B=2)
origin_pt_5 = Point(move_5.Geometry)
move_49 = Move(Geometry=origin_pt_5, Motion=vec_19.Vector)  # -> Geometry, Transform
X_15 = UnitX(Factor=multiplication_6)
neg_10 = Negative(Value=X_15)
move_50 = Move(Geometry=move_49.Geometry, Motion=neg_10)  # -> Geometry, Transform
neg_11 = Negative(Value=dimension_offset)
lineardim_2 = DefineLinearDimension(
    Point1=move_50.Geometry,
    Point2=move_49.Geometry,
    DimensionPlane=xz_9,
    Offset=neg_11,
    DimensionStyle="Dim100 mid",
    OverwriteText=join)

addition_3 = Addition(A=dimension_offset, B=250)

# ---- group: Centerline
orign_end_point = Point(move_5.Geometry)
orign_point = Point(pt)
Z_12 = UnitZ(Factor=addition_3)
Z_13 = UnitZ(Factor=addition_3)
number_slider = Slider(0, range=0..100)
move_51 = Move(Geometry=orign_end_point, Motion=Z_13)  # -> Geometry, Transform
move_52 = Move(Geometry=orign_point, Motion=Z_12)  # -> Geometry, Transform

# ---- group: Left
panel_6 = Panel("Dim100")
xz_10 = XZPlane(Origin=Point(0, 0, 0))

# ----
# DIMENSION
lineardim_3 = DefineLinearDimension(Point1=move_52.Geometry, Point2=move_51.Geometry, DimensionPlane=xz_10, Offset=number_slider, DimensionStyle=panel_6)
lineardim_4 = DefineLinearDimension(Point1=move_32.Geometry, Point2=move_29.Geometry, DimensionPlane=xz_10, Offset=dimension_offset, DimensionStyle=panel_6)
lineardim_5 = DefineLinearDimension(Point1=pt_12, Point2=move_27.Geometry, DimensionPlane=xz_10, Offset=dimension_offset, DimensionStyle=panel_6)

# ----
# ANNOTATE SHEAR REBAR
lineardim_6 = DefineLinearDimension(
    Point1=move_48.Geometry,
    Point2=move_50.Geometry,
    DimensionPlane=xz_9,
    Offset=neg_11,
    DimensionStyle=panel_6,
    OverwriteText=shear_rebar_mid)

text_9 = Geometry([text_8, text_6, text_5, text_7])
dimensions_shear = Geometry([lineardim, lineardim_2])
longitudinal_bars = Curve([crv_3, top_rebar.Geometry, filter, bot_rebar.Geometry, crv_6])
dimensions = Geometry([lineardim_6, lineardim_5, lineardim_4, lineardim_3])
centerlines = Geometry([back_col.centerline, back_col_2.centerline])
text_10 = Geometry([text_2, relay_2, text_3, relay, ln_4, ln_3, ln_2, ln, text_9])
backlines = Geometry([back_col_2.back_line, back_col.back_line, bottom_line, top_line, cluster])
dimensions_shear_2 = ClusterOutput(dimensions_shear)
longitudinal_bars_2 = ClusterOutput(longitudinal_bars)
dimensions_2 = ClusterOutput(dimensions)
text_11 = ClusterOutput(text_10)
backlines_2 = ClusterOutput(backlines)
centerlines_2 = ClusterOutput(centerlines)

item = ListItem(List=arrlinear.Geometry, Index=expr("x-1", 0), Wrap=True)
item_2 = ListItem(List=arrlinear_2.Geometry, Index=expr("x-1", simplify(0)), Wrap=True)
line = Line(item)
line_2 = Line(item_2)
end = EndPoints(Curve=line)  # -> Start, End
end_2 = EndPoints(Curve=line_2)  # -> Start, End
shear_bar_mid = Number(python.M_ss)
dist = Distance(PointA=end.Start, PointB=end_2.Start)
expression_6 = Expression(x=dist, y=shear_bar_mid, Expression="x/y+1")
round = Round(Number=expression_6)  # -> Nearest, Floor, Ceiling

item_3 = ListItem(List=round.Nearest, Index=0, Wrap=True)
panel_7 = Panel(expression_6)

python_16 = GhPythonScript(C_Bool=python_10.C_Bool, N_C_Rebar=item_3)  # -> out, N_C
# ---------- python_16: Python ----------
#import rhinoscriptsyntax as rs

if (C_Bool == 1):
    N_C = N_C_Rebar

else:
    N_C = 0
# ---------- end python_16 ----------
expression_7 = Expression(x=dist, y=item_3, Expression="x/y")
vec_20 = VectorXYZ(XComponent=expression_7, YComponent=0, ZComponent=0)  # -> Vector, Length

item_4 = ListItem(List=vec_20.Vector, Index=0, Wrap=True)

arrlinear_3 = LinearArray(Geometry=line, Direction=item_4, Count=python_16.N_C)  # -> Geometry, Transform

panel_8 = Panel(item_4)
python_17 = GhPythonScript(x=arrlinear_3.Geometry, y=multiplication_4)  # -> out, a; inputs x: list
# ---------- python_17: Python ----------
a = []
for i in range(0,len(x)):
    if i > len(x)*(1/4- y/8) and i < len(x)*(1/4+ y/8) :
        a.append(x[i])

    if i > len(x)*(3/4- y/8) and i < len(x)*(3/4+ y/8) :
        a.append(x[i])
# ---------- end python_17 ----------
shear_bars = Curve([python_17.a, python_15.a, python_14.a])
shear_bars_2 = ClusterOutput(shear_bars)

# ==== cluster EndCol1
beam_depth = ClusterInput()
beam_depth_2 = ClusterInput()
beam_depth_3 = ClusterInput()
beam_depth_4 = ClusterInput()
beam_depth_5 = ClusterInput()
rise = ClusterInput()
data = Data(beam_depth)
python = GhPythonScript(x=data, move=beam_depth_2)  # -> Origin_pt, Beam_depth, Canti_length, Bool, T_A_mn1, T_A_md1, T_A_mn2, T_A_md2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
# ---------- python: Python ----------
import rhinoscriptsyntax as rs


Mid_section = x[1][31]
End_section = x[0][31]
Beam_depth = x[0][4]
Span_length = x[0][3]
T_A_mn1 = x[0][12]
T_A_md1 = x[0][13]
T_A_mn2 = x[0][14]
T_A_md2 = x[0][15]
T_L_en1 = x[0][16]
T_L_ed1 = x[0][17]
T_L_en2 = x[0][18]
T_L_ed2 = x[0][19]

E_slno = x[0][28]
E_sd = x[0][29]
E_ss = x[0][30]
M_sd = x[1][29]
M_ss = x[1][30]

B_A_mn1 = x[0][20]
B_A_md1 = x[0][21]
B_A_mn2 = x[0][22]
B_A_md2 = x[0][23]
B_L_en1 = x[0][24]
B_L_ed1 = x[0][25]
B_L_en2 = x[0][26]
B_L_ed2 = x[0][27]

# ORIGIN POINT DETERMINATION AND SPAN NO. DETERMINATION
if x[0][35] == "L":
    x1 = move + float(x[0][36])+ float(x[0][3])
    y1=0
    z1= float(x[0][37])
    Origin_pt = rs.AddPoint(x1,y1,z1)
    Bool =True
    Canti_length = x[0][3]

if x[0][35] == "R":
    x1 = move + float(x[0][36])
    y1=0
    z1= float(x[0][37])
    Origin_pt = rs.AddPoint(x1,y1,z1)
    Bool = False
    Canti_length = x[0][3]



if x[0][34] == "R":
    x1 = move + float(x[0][36]) + float(x[0][3])
    y1=0
    z1= float(x[0][37])
    Origin_pt = rs.AddPoint(x1,y1,z1)
    Bool = False
    Canti_length = 0


if x[0][34] == "L":
    x1 = move + float(x[0][36])
    y1=0
    z1= float(x[0][37])
    Origin_pt = rs.AddPoint(x1,y1,z1)
    Bool =True
    Canti_length = 0

#print x[0][34]

# GET BOOLEAN 
#if x[0][
# ---------- end python ----------

neg = Negative(ColWidth=beam_depth_5)
bool = Boolean(python.Bool)
expression = Expression(x=bool, y=neg, Expression="if(x=true,y/2,-y/2)")
neg_2 = Negative(BeamDepth=python.Beam_depth)
pt = Point(python.Origin_pt)
vec = VectorXYZ(XComponent=expression, YComponent=0, ZComponent=neg_2)  # -> Vector, Length
move = Move(Geometry=pt, Motion=vec.Vector)  # -> Geometry, Transform

cover_main = Slider(40, range=0..100)
addition = Addition(A=cover_main, B=5)
addition_2 = Addition(A=cover_main, B=Slider(35, range=0..100))
addition_3 = Addition(A=addition, B=Slider(35, range=0..100))
division = Division(ColWidth=beam_depth_5, B=2)

bool_2 = Boolean(python.Bool)
cluster = Cluster_2(
    A=python.Canti_length,
    origin_point=move.Geometry,
    col_width=beam_depth_5,
    bool=bool_2,
    rise=rise,
    beam_depth=python.Beam_depth)  # -> origin_point_5, G_2, G, origin_point_6, if_cantilever, ld_remain, back_line, centerline
python_2 = GhPythonScript(x=python.T_L_ed1)  # -> a
# ---------- python_2: Python ----------
if x is None:
    a = 0
else: 
    a = x
# ---------- end python_2 ----------
python_3 = GhPythonScript(x=python.T_A_mn1, y=python.T_A_md1, z=python.T_A_mn2, u=python.T_A_md2)  # -> out, tmain; inputs z: Int32, u: Int32; same code as python_2
python_4 = GhPythonScript(x=python.B_A_mn1, y=python.B_A_md1, z=python.B_A_mn2, u=python.B_A_md2)  # -> out, tmain; inputs z: Int32, u: Int32; same code as python_2
python_5 = GhPythonScript(x=python.T_L_en1, y=python.T_L_ed1, z=python.T_L_en2, u=python.T_L_ed2, v=python_3.tmain)  # -> out, tmain
# ---------- python_5: Python ----------
if x is not None and  int(x) !=0:
    if z is not None and int(z) !=0 :
        tmain =   str(x)+ "-T" +str(y)+ " + " +str(z)+ "-T" +str(u)+ " EX" 
#        tmain =   v + '+' +str(x)+ "-T" +str(y)+ " + " +str(z)+ "-T" +str(u)+ " EX" 

    else:
#        tmain =  v + '+ ' + str(x)+ "-T" +str(y)+ " EX" 
        tmain =   str(x)+ "-T" +str(y)+ " EX" 
#else:
#    tmain = v
# ---------- end python_5 ----------
python_6 = GhPythonScript(x=python.B_L_en1, y=python.B_L_ed1, z=python.B_L_en2, u=python.B_L_ed2, v=python_4.tmain)  # -> out, tmain
# ---------- python_6: Python ----------
if x is not None and  int(x) !=0:
    if z is not None and int(z) !=0 :
#        tmain =   v + '+' +str(x)+ "-T" +str(y)+ " + " +str(z)+ "-T" +str(u)+ " EX" 
        tmain =   str(x)+ "-T" +str(y)+ " + " +str(z)+ "-T" +str(u)+ " EX" 

    else:
#        tmain =  v + '+ ' + str(x)+ "-T" +str(y)+ " EX" 
        tmain =   str(x)+ "-T" +str(y)+ " EX" 

#else:
#    tmain = v
# ---------- end python_6 ----------
back_line = Line(cluster.back_line)
center_liner = Line(cluster.centerline)
rebar_top_extra = Panel(python_5.tmain)
rebar_top_main = Panel(python_3.tmain)
rebar_bottom_extra = Panel(python_6.tmain)
rebar_bottom_main = Panel(python_4.tmain)
center_liner_2 = ClusterOutput(center_liner)
max = Maximum(A=python.T_A_md1, B=python_2)
back_line_2 = ClusterOutput(back_line)
max_2 = Maximum(A=python.B_A_md1, B=python.B_L_ed1)
panel = Panel(max)

# ---- group: Rebar Top Extra
cover = Number(addition_2)
bool_3 = Boolean(bool_2)
cover_2 = Number(cover)
cover_3 = Number(cover)
expression_2 = Expression(x=bool_3, y=cover_2, Expression="if(x=true,y,-y)")
subtraction = Subtraction(A=cluster.ld_remain, B=cover_3)
cover_4 = Number(cover)
addition_4 = Addition(A=subtraction, ColWidth2=division)
neg_3 = Negative(Value=cover_4)
vec_2 = VectorXYZ(XComponent=expression_2, YComponent=0, ZComponent=neg_3)  # -> Vector, Length
X = UnitX(Factor=addition_4)
move_2 = Move(Geometry=cluster.G_2, Motion=vec_2.Vector)  # -> Geometry, Transform
bool_4 = Boolean(bool_2)
expression_3 = Expression(x=bool_4, y=X, Expression="if(x=true,y,-y)")
move_3 = Move(Geometry=move_2.Geometry, Motion=expression_3)  # -> Geometry, Transform

# ----
cover_5 = Number(cover_main)
bool_5 = Boolean(bool_2)
cover_6 = Number(cover_5)
cover_7 = Number(cover_5)
expression_4 = Expression(x=bool_5, y=cover_6, Expression="if(x=true,y,-y)")
subtraction_2 = Subtraction(A=cluster.ld_remain, B=cover_7)
cover_8 = Number(cover_5)
addition_5 = Addition(A=subtraction_2, ColWidth2=division)
neg_4 = Negative(Value=cover_8)
vec_3 = VectorXYZ(XComponent=expression_4, YComponent=0, ZComponent=neg_4)  # -> Vector, Length
X_2 = UnitX(Factor=addition_5)
move_4 = Move(Geometry=cluster.G_2, Motion=vec_3.Vector)  # -> Geometry, Transform
bool_6 = Boolean(bool_2)
expression_5 = Expression(x=bool_6, y=X_2, Expression="if(x=true,y,-y)")
move_5 = Move(Geometry=move_4.Geometry, Motion=expression_5)  # -> Geometry, Transform

ln = Line(StartPoint=move_4.Geometry, EndPoint=move_5.Geometry)
division_2 = Division(BeamDepth=python.Beam_depth, B=2)
subtraction_3 = Subtraction(A=division_2, Cover=cover_main)
Z = UnitZ(Factor=subtraction_3)
beam_depth_6 = ClusterInput()
rev = Reverse(Vector=Z)
mid_rebar_boolean = Boolean(beam_depth_6)
move_6 = Move(Geometry=ln, Motion=rev)  # -> Geometry, Transform
filter = StreamFilter(Gate=mid_rebar_boolean, Stream1=move_6.Geometry)

# ---- group: Rebar Top Extra
multiplication = Multiplication(Cantilever=python.Canti_length, B=1000)
multiplication_2 = Multiplication(TopRebarDia=python.T_A_md1, _60=60)
neg_5 = Negative(Value=cover)
subtraction_4 = Subtraction(LdBar=multiplication_2, ColWidth2=division, Cantilever=multiplication, Cover=neg_5)
expression_6 = Expression(x=subtraction_4, Expression="x")
expression_7 = Expression(x=subtraction_4, y=Slider(100, range=0..100), z=expression_6, Expression="if(x<0,y,z)")
Z_2 = UnitZ(Factor=expression_7)
rev_2 = Reverse(Vector=Z_2)
move_7 = Move(Geometry=move_2.Geometry, Motion=rev_2)  # -> Geometry, Transform

# ---- group: Rebar : Top Main Bar
multiplication_3 = Multiplication(Cantilever=python.Canti_length, B=1)
multiplication_4 = Multiplication(TopRebarDia=python.T_A_md1, _60=60)
neg_6 = Negative(Value=cover_5)
subtraction_5 = Subtraction(LdBar=multiplication_4, ColWidth2=division, Cantilever=multiplication_3, Cover=neg_6)
expression_8 = Expression(x=subtraction_5, Expression="x")
expression_9 = Expression(x=subtraction_5, y=Slider(200, range=0..200), z=expression_8, Expression="if(x<0,y,z)")
Z_3 = UnitZ(Factor=expression_9)
rev_3 = Reverse(Vector=Z_3)
move_8 = Move(Geometry=move_4.Geometry, Motion=rev_3)  # -> Geometry, Transform

# ----
ln_2 = Line(StartPoint=move_2.Geometry, EndPoint=move_3.Geometry)
ln_3 = Line(StartPoint=move_2.Geometry, EndPoint=move_7.Geometry)
ln_4 = Line(StartPoint=move_4.Geometry, EndPoint=move_5.Geometry)
join = JoinCurves(Curves=[ln_2, ln_3], Preserve=False)
ln_5 = Line(StartPoint=move_4.Geometry, EndPoint=move_8.Geometry)
join_2 = JoinCurves(Curves=[ln_4, ln_5], Preserve=False)
fillet = Fillet(Curve=join, Radius=Slider(25, range=0..100))
fillet_2 = Fillet(Curve=flatten(join_2), Radius=Slider(25, range=0..100))

panel_3 = Panel(python.E_ss)
python_7 = GhPythonScript(x=python.B_L_en1)  # -> a; same code as python_2

# ---- group: Rebar Bottom Extra
cover_9 = Number(addition_3)
cover_10 = Number(cover_9)
subtraction_6 = Subtraction(A=cluster.ld_remain, B=cover_10)
addition_6 = Addition(A=subtraction_6, ColWidth2=division)
cover_11 = Number(cover_9)
bool_7 = Boolean(bool_2)
expression_10 = Expression(x=bool_7, y=cover_11, Expression="if(x=true,y,-y)")
cover_12 = Number(cover_9)
X_3 = UnitX(Factor=addition_6)
subtraction_7 = Subtraction(A=cover_12, B=5)
vec_4 = VectorXYZ(XComponent=expression_10, YComponent=0, ZComponent=subtraction_7)  # -> Vector, Length
bool_8 = Boolean(bool_2)
move_9 = Move(Geometry=cluster.G, Motion=vec_4.Vector)  # -> Geometry, Transform
expression_11 = Expression(x=bool_8, y=X_3, Expression="if(x=true,y,-y)")
expression_12 = Expression(x=flatten(python_7), Expression="if ( int(x)>0,true,false)")

move_10 = Move(Geometry=move_9.Geometry, Motion=expression_11)  # -> Geometry, Transform

# ----
ln_6 = Line(StartPoint=move_9.Geometry, EndPoint=move_10.Geometry)
python_8 = GhPythonScript(x=python.T_L_en1)  # -> a; same code as python_2
expression_13 = Expression(x=python_8, Expression="if ( int(x)>0,true,false)")
dispatch = Dispatch(List=fillet, DispatchPattern=expression_13)  # -> ListA, ListB

cover_13 = Number(addition)
cover_14 = Number(cover_13)
subtraction_8 = Subtraction(A=cluster.ld_remain, B=cover_14)
cover_15 = Number(cover_13)
bool_9 = Boolean(bool_2)
addition_7 = Addition(A=subtraction_8, ColWidth2=division)
expression_14 = Expression(x=bool_9, y=cover_15, Expression="if(x=true,y,-y)")
X_4 = UnitX(Factor=addition_7)
bool_10 = Boolean(bool_2)
expression_15 = Expression(x=bool_10, y=X_4, Expression="if(x=true,y,-y)")

cover_16 = Number(cover_13)

subtraction_9 = Subtraction(A=cover_16, B=5)

vec_5 = VectorXYZ(XComponent=expression_14, YComponent=0, ZComponent=subtraction_9)  # -> Vector, Length
move_11 = Move(Geometry=cluster.G, Motion=vec_5.Vector)  # -> Geometry, Transform
move_12 = Move(Geometry=move_11.Geometry, Motion=expression_15)  # -> Geometry, Transform

# ---- group: Rebar : Shear
neg_7 = Negative(Value=cover_main)
bool_11 = Boolean(bool_2)
neg_8 = Negative(Value=cover_main)
expression_16 = Expression(x=bool_11, y=Slider(18, range=0..100), Expression="if(x=true,-y,y)")
neg_9 = Negative(Value=Slider(50, range=0..100))
neg_10 = Negative(Value=Slider(50, range=0..100))
neg_11 = Negative(Value=neg_7)
bool_12 = Boolean(bool_2)
bool_13 = Boolean(bool_2)
expression_17 = Expression(x=bool_12, y=neg_9, Expression="if(x=true,y,-y)")
expression_18 = Expression(x=bool_13, y=neg_10, Expression="if(x=true,y,-y)")
X_5 = UnitX(Factor=expression_16)
rev_4 = Reverse(Vector=X_5)
vec_6 = VectorXYZ(XComponent=expression_17, YComponent=0, ZComponent=neg_11)  # -> Vector, Length
vec_7 = VectorXYZ(XComponent=expression_18, YComponent=0, ZComponent=neg_8)  # -> Vector, Length
move_13 = Move(Geometry=cluster.origin_point_6, Motion=vec_6.Vector)  # -> Geometry, Transform
move_14 = Move(Geometry=cluster.origin_point_5, Motion=vec_7.Vector)  # -> Geometry, Transform
move_15 = Move(Geometry=move_11.Geometry, Motion=rev_4)  # -> Geometry, Transform
ln_7 = Line(StartPoint=move_14.Geometry, EndPoint=move_13.Geometry)
dist = Distance(PointA=move_13.Geometry, PointB=move_15.Geometry)
division_3 = Division(A=dist, StirrupDistance=python.E_ss)
round = Round(Number=division_3)  # -> Nearest, Floor, Ceiling
addition_8 = Addition(A=round.Ceiling, B=1)
division_4 = Division(A=dist, B=round.Ceiling)
bool_14 = Boolean(bool_2)
expression_19 = Expression(x=cluster.if_cantilever, y=division, z=addition_8, Expression="if ( x≤y/1000 ,0 , z)")
expression_20 = Expression(x=bool_14, y=division_4, Expression="if ( x=true,-1*y,y)")
X_6 = UnitX(Factor=expression_20)
arrlinear = LinearArray(Geometry=ln_7, Direction=X_6, Count=expression_19)  # -> Geometry, Transform

# ----
ln_8 = Line(StartPoint=move_11.Geometry, EndPoint=move_12.Geometry)
panel_4 = Panel(round.Ceiling)
panel_5 = Panel(division_4)
panel_6 = Panel(X_6)
line = Line(arrlinear.Geometry)
python_9 = GhPythonScript(x=line, y=beam_depth_4)  # -> out, a; inputs x: list
# ---------- python_9: Python ----------
a = []
y= y*0.8 
for i in range(0,len(x)):
    if i > len(x)*(1- y)/2 and i < len(x)*(1+ y)/2 :
        a.append(x[i])
# ---------- end python_9 ----------
shear_rebar = ClusterOutput(python_9.a)

# ---- group: Rebar Bottom Extra
multiplication_5 = Multiplication(Cantilever=python.Canti_length, B=1000)
multiplication_6 = Multiplication(TopRebarDia=max, _60=60)
neg_12 = Negative(Value=cover_9)
subtraction_10 = Subtraction(LdBar=multiplication_6, ColWidth2=division, Cantilever=multiplication_5, Cover=neg_12)
expression_21 = Expression(x=subtraction_10, Expression="x")
expression_22 = Expression(x=subtraction_10, y=Slider(100, range=0..100), z=expression_21, Expression="if(x<0,y,z)")
Z_4 = UnitZ(Factor=expression_22)
move_16 = Move(Geometry=move_9.Geometry, Motion=Z_4)  # -> Geometry, Transform

# ----
ln_9 = Line(StartPoint=move_9.Geometry, EndPoint=move_16.Geometry)
join_3 = JoinCurves(Curves=[ln_9, ln_6], Preserve=False)

# ---- group: Rebar Bottom Extra (continued)
fillet_3 = Fillet(Curve=join_3, Radius=Slider(25, range=0..100))

# ----
dispatch_2 = Dispatch(List=flatten(fillet_3), DispatchPattern=expression_12)  # -> ListA, ListB

# ---- group: Rebar : Bottom Main
multiplication_7 = Multiplication(Cantilever=python.Canti_length, B=1000)
multiplication_8 = Multiplication(TopRebarDia=max, _60=60)
neg_13 = Negative(Value=cover_13)

# ----
addition_9 = Addition(A=neg_13, B=-10)

# ---- group: Rebar : Bottom Main (continued)
subtraction_11 = Subtraction(LdBar=multiplication_8, ColWidth2=division, Cantilever=multiplication_7, Cover=addition_9)
expression_23 = Expression(x=subtraction_11, Expression="x")
expression_24 = Expression(x=subtraction_11, y=Slider(200, range=0..200), z=expression_23, Expression="if(x<0,y,z)")
Z_5 = UnitZ(Factor=expression_24)
move_17 = Move(Geometry=move_11.Geometry, Motion=Z_5)  # -> Geometry, Transform

# ----
ln_10 = Line(StartPoint=move_11.Geometry, EndPoint=move_17.Geometry)
join_4 = JoinCurves(Curves=[ln_8, ln_10], Preserve=False)
fillet_4 = Fillet(Curve=join_4, Radius=Slider(25, range=0..100))
crv = Curve([filter, fillet_2, fillet_4, dispatch_2.ListA, dispatch.ListA])
long_rebar = ClusterOutput(crv)

colour = ColourPicker(PickedColour=RGB(140, 41, 41))
position_text = PositionText(bool=bool_2, col_width=beam_depth_5, beam_depth=python.Beam_depth)  # -> x_move_2, z_move_2
bool_15 = Boolean(bool_2)
bool_16 = Boolean(bool_15)
expression_25 = Expression(x=bool_16, Expression="if(x = true,\"TopLeft\",\"BottomRight\")")
expression_26 = Expression(x=bool_15, y=rebar_bottom_extra, z=rebar_top_extra, Expression="if( x = true, y,z)")
panel_7 = Panel(expression_25)

# ---- group: Dimension
# DIMENSION
Z_6 = UnitZ(Factor=rise)
Z_7 = UnitZ(Factor=rise)
neg_14 = Negative(Value=Z_7)
neg_15 = Negative(Value=Z_6)
move_18 = Move(Geometry=pt, Motion=neg_14)  # -> Geometry, Transform
move_19 = Move(Geometry=cluster.G_2, Motion=neg_15)  # -> Geometry, Transform
xz = XZPlane(Origin=Point(0, 0, 0))
lineardim = DefineLinearDimension(Point1=move_18.Geometry, Point2=move_19.Geometry, DimensionPlane=xz, Offset=0, DimensionStyle="Dim100")

# ---- group: Annotate : Long Bar Name / Annotate : Top Main
vec_8 = VectorXYZ(XComponent=position_text.x_move_2, YComponent=0, ZComponent=position_text.z_move_2)  # -> Vector, Length
move_20 = Move(OriginPt=pt, Motion=vec_8.Vector)  # -> Geometry, Transform
xz_2 = XZPlane(Origin=move_20.Geometry)

# ----
text = DefineTextObject(Text=expression_26, Plane=xz_2, DimensionStyle="Dim100", Justification=panel_7, Size=beam_depth_3, OutputType="Text")

dimension = Geometry(lineardim)
text_2 = Geometry(text)
text_3 = ClusterOutput(text_2)
dimension_2 = ClusterOutput(dimension)

# ==== cluster CrossSection
max_row = ClusterInput()
slab_extension_mm = ClusterInput()
slab_depth_mm = ClusterInput()
clear_cover = ClusterInput()
max_row_2 = Text(max_row)
text_size = ClusterInput()
data = ClusterInput()
move = ClusterInput()
text_size_2 = Number(text_size)
data_2 = Data(data)
move_2 = Number(move)
section_distance = ClusterInput()
python = GhPythonScript(x=data_2, move=move_2)  # -> CS_Name, Origin_pt, Beam_width, Beam_depth, T_A_mn1, T_A_md1, T_A_mn2, T_A_md2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; inputs x: list
# ---------- python: Python ----------
import rhinoscriptsyntax as rs
#

CS_Name = x[0][31]
Beam_depth = x[0][4]
Beam_width = x[0][5]
T_A_mn1 = x[0][12]
T_A_md1 = x[0][13]
T_A_mn2 = x[0][14]
T_A_md2 = x[0][15]
T_L_en1 = x[0][16]
T_L_ed1 = x[0][17]
T_L_en2 = x[0][18]
T_L_ed2 = x[0][19]

S_L = x[0][28]
#print S_L
S_D = x[0][29]
S_S = x[0][30]

B_A_mn1 = x[0][20]
B_A_md1 = x[0][21]
B_A_mn2 = x[0][22]
B_A_md2 = x[0][23]
B_L_en1 = x[0][24]
B_L_ed1 = x[0][25]
B_L_en2 = x[0][26]
B_L_ed2 = x[0][27]


## ORIGIN POINT DETERMINATION AND SPAN NO. DETERMINATION

x1= move 
y1= 0
z1= 0

Origin_pt = rs.AddPoint(x1,y1,z1)
# ---------- end python ----------
division = Division(A=python.T_A_md1, B=2)
section_distance_2 = Number(section_distance)
python_2 = GhPythonScript(x=flatten(python.Origin_pt), factor=section_distance_2)  # -> out, graft(a); inputs x: list
# ---------- python_2: Python ----------
import rhinoscriptsyntax as rs

#import ghpythonlib.treehelpers as th
#a_list = th.tree_to_list(x,lambda data:data)

a = []

for i in range(0,len(x)):
    pt = rs.coerce3dpoint(x[i])
    pt[0] = pt[0] + float(factor)*i
    print pt
    a.append(pt)
a=a
# ---------- end python_2 ----------
panel = Panel(python_2.a)
cluster = Cluster_3(
    cover=clear_cover,
    stirrup_diameter=python.S_D,
    beam_depth=python.Beam_depth,
    beam_width_mm=python.Beam_width,
    slab_depth_mm=slab_depth_mm,
    slab_extension_mm=slab_extension_mm,
    origin_point=panel,
    long_bar_radius=division)  # -> stirrup_exterior, breaklines, stirrup_diameter_3, beam_width_mm_3, beam_section_back_line_2, long_bar_radius_3
line = Line(cluster.beam_section_back_line_2)
crv = Curve(cluster.breaklines)
rec = Rectangle(cluster.stirrup_exterior)
relay = Relay([crv, line])
edges = BrepEdges(Brep=rec)  # -> Naked, Interior, NonManifold
# SECTION OF BEAM
item = ListItem(List=edges.Naked, Index=0, Wrap=True)
len = Length(Curve=item)
division_2 = Division(A=len, B=2)
subtraction = Subtraction(A=division_2, B=cluster.stirrup_diameter_3)

# ----
# ANNOTATE BEAM DIMENSIONS
number_slider = Slider(8, range=0..10)
item_2 = ListItem(List=line, Index=number_slider, Wrap=True)
curvepoint = PointOnCurve(item_2, parameter=0)
curvepoint_2 = PointOnCurve(item_2, parameter=1)
Z = UnitZ(SlabDepth=slab_depth_mm)
slab_extension = Number(slab_extension_mm)
move_3 = Move(Geometry=curvepoint, Motion=Z)  # -> Geometry, Transform
addition = Addition(A=slab_extension, B=50)
item_3 = ListItem(List=line, Index=Slider(5, range=0..10), Wrap=True)
dimension_vertical = DimensionVertical(first_pt=move_3.Geometry, second_pt=curvepoint_2, dimension_offset=addition, txt="Dim100")
number_slider_2 = Slider(-300, range=-400..401)
curvepoint_3 = PointOnCurve(item_3, parameter=0)
curvepoint_4 = PointOnCurve(item_3, parameter=1)
xz = XZPlane(Origin=Point(0, 0, 0))
geo = Geometry(dimension_vertical)
lineardim = DefineLinearDimension(Point1=curvepoint_3, Point2=curvepoint_4, DimensionPlane=xz, Offset=number_slider_2, DimensionStyle="Dim100")

python_3 = GhPythonScript(
    x=python.B_A_mn1,
    y=python.B_A_md1,
    z=python.B_A_mn2,
    u=python.B_A_md2,
    v=python.B_L_en1,
    w=python.B_L_ed1,
    s=python.B_L_en2,
    t=python.B_L_ed2)  # -> out, tmain; inputs z: Int32, u: Int32
# ---------- python_3: Python ----------
a = []


if z is not None and z!=0 :
    tmain = str(x)+ "-T" +str(y)+ " + " +str(z)+ "-T" +str(u)+ " TH" 
else:
    tmain =  str(x)+ "-T" +str(y)+ " TH" 


if v is not None and  int(v) !=0:
    if s is not None and int(t) !=0 :
        tmain =   tmain + '+' +str(v)+ "-T" +str(w)+ " + " +str(s)+ "-T" +str(t)+ " EX" 
    else:
        tmain =  tmain + '+ ' + str(v)+ "-T" +str(w)+ " EX" 
else:
    tmain = tmain

print tmain
# ---------- end python_3 ----------
python_4 = GhPythonScript(
    x=python.T_A_mn1,
    y=python.T_A_md1,
    z=python.T_A_mn2,
    u=python.T_A_md2,
    v=python.T_L_en1,
    w=python.T_L_ed1,
    s=python.T_L_en2,
    t=python.T_L_ed2)  # -> out, tmain; inputs z: Int32, u: Int32; same code as python_3
rebar_top_main = Panel(python_3.tmain)
rebar_top_main_2 = Panel(python_4.tmain)
pt = Point(panel)
addition_2 = Addition(BeamDepth=python.Beam_depth, _10=Slider(20, range=0..100))
item_4 = ListItem(List=rebar_top_main_2, Index=0, Wrap=True)
item_5 = ListItem(List=rebar_top_main, Index=0, Wrap=True)
xz_2 = XZPlane(OriginPt=pt)
relay_2 = Relay([lineardim, geo])
Z_2 = UnitZ(Factor=addition_2)
division_3 = Division(SlabDepth=slab_depth_mm, B=2)
xz_3 = XZPlane(OriginPt=panel)
rev = Reverse(Vector=Z_2)
Z_3 = UnitZ(Factor=division_3)
move_4 = Move(Geometry=xz_3, Motion=Z_3)  # -> Geometry, Transform
move_5 = Move(Geometry=xz_2, Motion=rev)  # -> Geometry, Transform
text = DefineTextObject(
    Text=item_4,
    Plane=move_4.Geometry,
    DimensionStyle="Dim100",
    Justification="BottomCenter",
    Size=text_size_2,
    OutputType="Text")
text_2 = DefineTextObject(
    Text=item_5,
    Plane=move_5.Geometry,
    DimensionStyle="Dim100",
    Justification="TopCenter",
    Size=text_size_2,
    OutputType="Text")
origin_point = Point(panel)

# ----
# ANNOTATION : NAME OF CS
number_slider_3 = Slider(5, range=0..10)
item_6 = ListItem(List=line, Index=number_slider_3, Wrap=True)
subtraction_2 = Subtraction(A=number_slider_2, B=Slider(100, range=0..1000))
curvepoint_5 = PointOnCurve(item_6, parameter=0.507)
Z_4 = UnitZ(Factor=subtraction_2)
move_6 = Move(Geometry=curvepoint_5, Motion=Z_4)  # -> Geometry, Transform
xz_4 = XZPlane(Origin=move_6.Geometry)
python_5 = GhPythonScript(cs_name=python.CS_Name)  # -> out, a
# ---------- python_5: Python ----------
#
#if str(x) == 'end':
#    a = 'CS AT A'
#elif str(x) == 'mid':
#    a = 'CS AT B'
#    
a = 'CS at ' + cs_name
# ---------- end python_5 ----------
text_3 = DefineTextObject(Text=python_5.a, Plane=xz_4, DimensionStyle="Dim100", Justification="TopCenter", Size=text_size_2, OutputType="Text")

X = UnitX(Factor=Slider(20, range=0..100))
xz_5 = XZPlane(Origin=Point(0, 0, 0))

# ----
# CALCULATIONS
offset = OffsetCurve(Curve=rec, StirrupDia=cluster.stirrup_diameter_3, Plane=xz_5, Corners=1)
fillet_radius = Slider(8, range=0..10)
explode = Explode(Curve=offset, Recursive=True)  # -> Segments, Vertices
fillet = Fillet(Curve=offset, Radius=fillet_radius)
item_7 = ListItem(List=explode.Vertices, Index=0, Wrap=True)
item_8 = ListItem(List=explode.Vertices, Index=Slider(1, range=0..1), Wrap=True)
stirrup_bar_dia = Number(cluster.stirrup_diameter_3)
beam_width = Number(cluster.beam_width_mm_3)
long_bar_radius = Number(cluster.long_bar_radius_3)
clear_cover_2 = Number(clear_cover)
Y = UnitY(Factor=1)
expression = Expression(x=beam_width, y=clear_cover_2, z=stirrup_bar_dia, a=long_bar_radius, Expression="x-2*y-2*z-2*a")
neg = Negative(BarRadius=cluster.long_bar_radius_3)
neg_2 = Negative(LongBarRadius=cluster.long_bar_radius_3)
Y_2 = UnitY(Factor=1)
circle = CircleCNR(Center=item_8, Normal=Y, LongBarRadius=cluster.long_bar_radius_3)
circle_2 = CircleCNR(Center=item_7, Normal=Y_2, LongBarRadius=cluster.long_bar_radius_3)
vec = VectorXYZ(XComponent=neg, YComponent=0, ZComponent=cluster.long_bar_radius_3)  # -> Vector, Length
X_2 = UnitX(Factor=expression)
vec_2 = VectorXYZ(XComponent=neg_2, YComponent=0, ZComponent=neg_2)  # -> Vector, Length
rev_2 = Reverse(Vector=X_2)
move_7 = Move(Geometry=circle, Motion=vec.Vector)  # -> Geometry, Transform
move_8 = Move(Geometry=circle_2, Motion=vec_2.Vector)  # -> Geometry, Transform
move_9 = Move(Geometry=move_8.Geometry, Motion=rev_2)  # -> Geometry, Transform

# ----
# LONGITUDINAL BAR ARRAY
python_6 = GhPythonScript(
    tm_n=python.T_A_mn1,
    tm_n1=python.T_A_mn2,
    te_n=python.T_L_en1,
    te_n1=python.T_L_en2,
    bm_n=python.B_A_mn1,
    bm_n1=python.B_A_mn2,
    be_n=python.B_L_en1,
    be_n1=python.B_L_en2,
    max_row=max_row_2)  # -> tfrn, tsrn, bfrn, bsrn; inputs tm_n: Int32, tm_n1: Int32, te_n: Int32, te_n1: Int32, bm_n: Int32, bm_n1: Int32, be_n: Int32, be_n1: Int32
# ---------- python_6: Python ----------
tm_n1 = 0 if tm_n1 is None else tm_n1
te_n = 0 if te_n is None else te_n
te_n1 = 0 if te_n1 is None else te_n1

bm_n1 = 0 if bm_n1 is None else bm_n1
be_n = 0 if be_n is None else be_n
be_n1 = 0 if be_n1 is None else be_n1





total_bars_top = tm_n + te_n + tm_n1 + te_n1
total_bars_bottom = bm_n + be_n + bm_n1 + be_n1

max_row= int(max_row)

if total_bars_top > max_row:
    top_first_row_no = max_row
    top_second_row_no = total_bars_top - top_first_row_no
elif total_bars_top <= max_row:
    top_first_row_no = total_bars_top
    top_second_row_no = 0

if total_bars_bottom > max_row:
    bottom_first_row_no = max_row
    bottom_second_row_no = total_bars_bottom - bottom_first_row_no
elif total_bars_bottom <= max_row:
    bottom_first_row_no = total_bars_bottom
    bottom_second_row_no = 0

tfrn= top_first_row_no
tsrn= top_second_row_no
bfrn= bottom_first_row_no
bsrn= bottom_second_row_no
# ---------- end python_6 ----------
item_9 = ListItem(List=python_6.bfrn, Index=0, Wrap=True)
item_10 = ListItem(List=python_6.tfrn, Index=0, Wrap=True)
multiplication = Multiplication(A=cluster.long_bar_radius_3, B=2)
multiplication_2 = Multiplication(LongBarRadius=cluster.long_bar_radius_3, B=2)
addition_3 = Addition(A=multiplication, B=25)
Z_5 = UnitZ(Factor=addition_3)
subtraction_3 = Subtraction(A=item_10, B=1)
subtraction_4 = Subtraction(A=python_6.tsrn, B=1)
subtraction_5 = Subtraction(A=item_9, B=1)
addition_4 = Addition(A=multiplication_2, B=25)
subtraction_6 = Subtraction(A=python_6.bsrn, B=1)
rev_3 = Reverse(Vector=Z_5)
Z_6 = UnitZ(Factor=addition_4)
division_4 = Division(A=rev_2, B=subtraction_5)
division_5 = Division(A=rev_2, B=subtraction_3)
division_6 = Division(A=rev_2, B=subtraction_4)
division_7 = Division(A=rev_2, B=subtraction_6)
move_10 = Move(Geometry=move_8.Geometry, Motion=rev_3)  # -> Geometry, Transform
arrlinear = LinearArray(Geometry=move_7.Geometry, Direction=division_4, Count=item_9)  # -> Geometry, Transform
move_11 = Move(Geometry=move_7.Geometry, Motion=Z_6)  # -> Geometry, Transform
arrlinear_2 = LinearArray(Geometry=move_10.Geometry, Direction=division_6, Count=python_6.tsrn)  # -> Geometry, Transform
arrlinear_3 = LinearArray(Geometry=move_8.Geometry, Direction=division_5, Count=item_10)  # -> Geometry, Transform
arrlinear_4 = LinearArray(Geometry=move_11.Geometry, Direction=division_7, Count=python_6.bsrn)  # -> Geometry, Transform
patch = Patch(Curves=graft(arrlinear.Geometry), Spans=20, Flexibility=1, Trim=True)
relay_3 = Relay([arrlinear.Geometry, arrlinear_3.Geometry, arrlinear_2.Geometry, arrlinear_4.Geometry])

number_slider_4 = Slider(2, range=0..10)

# ----
# Hooks
darc = DeconstructArc(Arc=move_9.Geometry)  # -> BasePlane, Radius, Angle
stirrup_diameter = Number(cluster.stirrup_diameter_3)
center_point = Point(darc.BasePlane)
bar_dia = Number(cluster.long_bar_radius_3)
hooks_cl = HooksCL(origin_pt=center_point, shear_bar_dia=stirrup_diameter, longitudinal_bar_radius=bar_dia)

mid_rebar_boolean = ClusterInput()
Z_7 = UnitZ(Factor=subtraction)
hatch = DefineHatch(Curve=arrlinear_3.Geometry, Pattern="Solid", Rotation=0, Scale=1)
hatch_2 = DefineHatch(Curve=arrlinear.Geometry, Pattern="Solid", Rotation=0, Scale=1)
hatch_3 = DefineHatch(Curve=arrlinear_2.Geometry, Pattern="Solid", Rotation=0, Scale=1)
stirrup_legs = Number(python.S_L)
rev_4 = Reverse(Vector=Z_7)
mid_rebar_boolean_2 = Boolean(mid_rebar_boolean)
expression_2 = Expression(x=stirrup_legs, Expression="if ( x = 3, 0,1)")
move_12 = Move(Geometry=[move_8.Geometry, move_9.Geometry], Motion=rev_4)  # -> Geometry, Transform
geo_2 = Geometry([hatch_2, hatch_3, hatch])
filter = StreamFilter(Gate=mid_rebar_boolean_2, Stream1=move_12.Geometry)
hatch_4 = DefineHatch(Curve=filter, Pattern="Solid", Rotation=0, Scale=1)
section_rebar = Geometry([geo_2, hatch_4])
dimensions = Geometry(relay_2)
backlines = Curve(relay)
long_rebar = ClusterOutput(section_rebar)
dimensions_2 = ClusterOutput(dimensions)
backlines_2 = ClusterOutput(backlines)

# ----
# SHEAR  BAR DETAILS
# ANNOTATION : SHEAR BARS
stirrup_spacing = Number(python.S_S)
leg_no = Number(python.S_L)
leg_dia = Number(python.S_D)
python_7 = GhPythonScript(x=leg_no, y=leg_dia, z=stirrup_spacing)  # -> out, tmain; inputs x: list, y: list, z: list
# ---------- python_7: Python ----------
tmain = []

for i in range ( len(x)):
    tmain.append(str(int(x[i])) + "L-T" + str(int(y[i]))+ "@"+ str(int(z[i])))
    print tmain[i]
# ---------- end python_7 ----------
rebar_top_main_3 = Panel(python_7.tmain)
item_11 = ListItem(List=line, Index=Slider(4, range=0..10), Wrap=True)
curvepoint_6 = PointOnCurve(item_11, parameter=0.507)
item_12 = ListItem(List=rebar_top_main_3, Index=0, Wrap=True)

move_13 = Move(Geometry=curvepoint_6, Motion=X)  # -> Geometry, Transform

xz_6 = XZPlane(Origin=move_13.Geometry)
text_4 = DefineTextObject(Text=item_12, Plane=xz_6, DimensionStyle="Dim100", Justification="RightCenter", Size=text_size_2, OutputType="Text")

relay_4 = Relay([text_4, text_3])
texts = Geometry([text_2, relay_4, text])
texts_2 = ClusterOutput(texts)

# ---- group: Inner stirrup
offset_2 = OffsetCurve(Curve=offset, LongBarRadius=cluster.long_bar_radius_3, Plane=xz_5, Corners=1)
number_slider_5 = Slider(3, range=0..10)
edges_2 = BrepEdges(Brep=offset_2)  # -> Naked, Interior, NonManifold
item_13 = ListItem(List=edges_2.Naked, Index=0, Wrap=True)  # -> Item, Item1, Item2, Item3
subtraction_7 = Subtraction(Legs=python.S_L, B=1)
len_2 = Length(Curve=item_13.Item1)
division_8 = Division(A=len_2, B=subtraction_7)
subtraction_8 = Subtraction(A=division_8, LongBarRadius=cluster.long_bar_radius_3)
multiplication_3 = Multiplication(A=division_8, B=2)
addition_5 = Addition(A=multiplication_3, B=cluster.long_bar_radius_3)
X_3 = UnitX(Factor=subtraction_8)
X_4 = UnitX(Factor=addition_5)
move_14 = Move(Geometry=item_13.Item2, Motion=X_3)  # -> Geometry, Transform
move_15 = Move(Geometry=item_13.Item2, Motion=X_4)  # -> Geometry, Transform
larger = LargerThan(FirstNumber=python.S_L, SecondNumber=Slider(2, range=0..10))  # -> LargerThan, OrEqualTo

# ----
X_5 = UnitX(Factor=division_8)
panel_2 = Panel(larger.LargerThan)
move_16 = Move(Geometry=hooks_cl, Motion=X_5)  # -> Geometry, Transform
item_14 = ListItem(List=move_16.Geometry, Index=0, Wrap=True)
filter_2 = StreamFilter(Gate=expression_2, Stream0=item_14, Stream1=move_16.Geometry)

# ---- group: Inner stirrup (continued)
filter_3 = StreamFilter(Gate=larger.LargerThan, Stream1=[move_15.Geometry, move_14.Geometry, filter_2])

# ----
dispatch = Dispatch(List=flatten([move_14.Geometry, move_15.Geometry, filter_2]), DispatchPattern=graft(panel_2))  # -> ListA, ListB
stirrup = Curve([fillet, hooks_cl, dispatch.ListA])
rebar_shear = Geometry([filter, stirrup, relay_3])
long_rebar_2 = ClusterOutput(rebar_shear)

# ==== cluster Cluster_4
number_slider = Slider(38, range=0..100)
dom = ConstructDomain(DomainStart=Slider(0, range=0..1), DomainEnd=number_slider)
range = Range(Domain=dom, Steps=number_slider)
cull_i = CullIndex(List=range, Indices=0, Wrap=True)
read = ClusterInput()
worksheet = ClusterInput()
rowstart = ClusterInput()
rowend = ClusterInput()
excelread = ExcelReaderLEGACY(ReadToggle=read, Worksheet=worksheet, Column=cull_i, RowStart=rowstart, RowEnd=rowend)  # -> Exceptions, simplify(ExcelData)
panel = Panel(excelread.ExcelData)
data = Data(excelread.ExcelData)
panel_2 = Panel(data)
# FILTER FRAMES AS PER STORIES ++ SEPARATE CANTILEVER
viewer = ParamViewer(panel_2)
item = ListItem(List=viewer, Index=Slider(2, range=0..10), Wrap=True)  # -> Item2, Item1, Item, Item1_2
flip = FlipMatrix(Data=data)
branch = TreeBranch(Tree=panel_2, Path=item.Item, MaintainPaths=True)
branch_2 = TreeBranch(Tree=panel_2, Path=item.Item2, MaintainPaths=True)
panel_3 = Panel(flip)
python = GhPythonScript(frames=branch_2, stories=branch)  # -> out, a; inputs frames: list, stories: list
# ---------- python: Python ----------
import ghpythonlib.treehelpers as th

story_grp= []

print stories 

for story in stories:
    if story not in story_grp:
        story_grp.append(story)

layernames = story_grp
#print story_grp
layerTree = [list() for item in story_grp]

for i in range(len(story_grp)):
    layerTree[i].append(story_grp[i])
    temp= []
    for j in range(0, len(frames)-1):
        if stories[j] == story_grp[i]:
            if frames[j] not in temp:
                temp.append(frames[j])
                layerTree[i].append(frames[j])

#print layerTree
layerTree = th.list_to_tree(layerTree, source=[])
a = layerTree

print a
# ---------- end python ----------
panel_4 = Panel(python.a)
relay = ClusterOutput(panel_3)
python_2 = GhPythonScript(data=panel_3, story_frm=panel_4)  # -> arranged; inputs data: tree, story_frm: list
# ---------- python_2: Python ----------
import ghpythonlib.treehelpers as th
#a_tree = th.list_to_tree(a_list)
a_list = th.tree_to_list(data,lambda data:data)

arranged =[]
for k in range(0,len(story_frm)-1):
    arranged.append([])
#print arranged

for j in range(1,len(story_frm)):
    for i in range(0,len(a_list)):
        if a_list[i][0] == story_frm[j] and a_list[i][1] == "L":  
            arranged[j-1].append(a_list[i])
#            print(arranged)
        if a_list[i][0] == story_frm[j] and a_list[i][1] == "M":    
            arranged[j-1].append(a_list[i])
        if a_list[i][0] == story_frm[j] and a_list[i][1] == "R":    
            arranged[j-1].append(a_list[i])

#for j in range(0,len(story_frm)-1):
#    for i in range(0,len(a_list)):
#        if a_list[i][0] == story_frm[j] and a_list[i][1] == "L":    
#            arranged[j].append(a_list[i])
#        if a_list[i][0] == story_frm[j] and a_list[i][1] == "M":    
#            arranged[j].append(a_list[i])
#        if a_list[i][0] == story_frm[j] and a_list[i][1] == "R":    
#            arranged[j].append(a_list[i])
        
        
#print len(arranged)
        
#arranged = th.list_to_tree(arranged, source=[0,0])
#arranged = th.list_to_tree(arranged, False, source=[])
print (arranged[0])
#print story_frame
#print arranged
# ---------- end python_2 ----------
python_3 = GhPythonScript(x=python_2)  # -> x, a, span_no; inputs x: list
# ---------- python_3: Python ----------
#Get mid parts from the list of beam lists, popped is saved in new array a. 
a=[]

#print len(x)

#print x[0][0][35]
#b= len(x)
#c = 0
#for i in range(0,b):
#    print (b) 
#    if c== 0 : 
#        if  x[i][0][35] == "L" or x[i][0][35] == "R" :
#           a.append(x.pop(i))
#           c=1
#           print( len(x))
#    if c== 1 : 
#        if  x[i][1][35] == "L" or x[i][1][35] == "R" :
#           a.append(x.pop(i))

if  x[0][0][35] == "L" or x[0][0][35] == "R" :
    a.append(x.pop(0))

if  x[-1][0][35] == "L" or x[-1][0][35] == "R" :
    a.append(x.pop(-1))

#x=x
span_no = len(x)

#print type(span_no)
#If empty in L or Right add new thing. 
if len(x) > 1 : 
    if a == [] :
        a.append(x[0])
        a[0][0][34]="L"
        a.append(x[-1])
        a[1][0][34]="R"

    if len(a) ==1:
        if a[0][0][35]== "L" :
            a.append(x[-1])
            a[1][0][34]="R"
        if a[0][0][35] == "R" :
            a.append(x[0])
            a[1][0][34]="L"

# FOR SPAN=1 - APPEND AS PER LEFT OR RIGHT 
if len(x) ==1:
    if len(a) ==1:
        if a[0][0][35]== "L" :
            a.append([])
            a[1].append(x[0][0])
            a[1].append(x[0][0])
            a[1].append(x[0][0])
            a[1][0][34]="R"
        if a[0][0][35] == "R" :
            a.append([])
            a[1].append(x[0][1])
            a[1].append(x[0][1])
            a[1].append(x[0][1])
            a[1][0][34]="L"

    if len(a) == 0 :
        a.append([])
        a[0].append(x[0][0])
        a[0].append(x[0][0])
        a[0].append(x[0][0])
        a[0][0][34]="L"

        a.append([])
        a[1].append(x[0][1])
        a[1].append(x[0][1])
        a[1].append(x[0][1])
        a[1][0][34]="R"

#print a[0][0][34]
#print a[1][0][34]

#print x 
#print a
# ---------- end python_3 ----------
panel_5 = Panel(python_3.x)
panel_6 = Panel(python_3.a)
x = ClusterOutput(python_3.x)
span_no = ClusterOutput(python_3.span_no)
a = ClusterOutput(python_3.a)

# ==== cluster Cluster_5
number_slider = Slider(75, range=0..100)
worksheet = ClusterInput()
excelread = ExcelReaderLEGACY(
    ReadToggle=Toggle(True),
    Worksheet=worksheet,
    Column=Slider(1, range=0..1),
    RowStart=Slider(7, range=0..10),
    RowEnd=Slider(150, range=0..1000))  # -> Exceptions, simplify(ExcelData)
python = GhPythonScript(x=excelread.ExcelData)  # -> out, a
# ---------- python: Python ----------
if x is not None :
    a = True
# ---------- end python ----------
data = Data(excelread.ExcelData)
dispatch = Dispatch(List=data, DispatchPattern=python.a)  # -> ListA, ListB
lng = ListLength(List=dispatch.ListA)
subtraction = Subtraction(A=lng, B=1)
R = ClusterOutput(subtraction)

# ==== cluster BackCol
boolean = ClusterInput()
col_width = ClusterInput()
origin_point = ClusterInput()
bool = Boolean(boolean)
pt = Point(origin_point)
expression = Expression(x=col_width, y=bool, Expression="if(y=true, x/2-100, -x/2+100)")
expression_2 = Expression(x=col_width, y=bool, Expression="if(y=true, x/2, -x/2)")
beam_depth = ClusterInput()
F = ClusterInput()
X = UnitX(Factor=expression)
division = Division(A=beam_depth, B=2)
neg = Negative(Value=F)
X_2 = UnitX(Factor=expression_2)
Z = UnitZ(Factor=F)
addition = Addition(A=neg, B=division)
Z_2 = UnitZ(Factor=addition)
move = Move(Geometry=pt, Motion=Z)  # -> Geometry, Transform
move_2 = Move(Geometry=move.Geometry, Motion=X)  # -> Geometry, Transform
expression_3 = Expression(x=move_2.Geometry, y=bool, Expression="if(y=true, 100, -100)")
ln = Line(StartPoint=move_2.Geometry, EndPoint=move.Geometry)
X_3 = UnitX(Factor=expression_3)
move_3 = Move(Geometry=move_2.Geometry, Motion=X_3)  # -> Geometry, Transform
ln_2 = Line(StartPoint=pt, EndPoint=move.Geometry)
move_4 = Move(Geometry=move.Geometry, Motion=X_2)  # -> Geometry, Transform
move_5 = Move(Geometry=move_4.Geometry, Motion=Z_2)  # -> Geometry, Transform
expression_4 = Expression(y=bool, Expression="if(y=true, -100, 100)")
Z_3 = UnitZ(Factor=expression_4)
rev = Reverse(Vector=Z_3)
move_6 = Move(Geometry=move_3.Geometry, Motion=rev)  # -> Geometry, Transform
ln_3 = Line(StartPoint=move_3.Geometry, EndPoint=move_6.Geometry)
ln_4 = Line(StartPoint=move_2.Geometry, EndPoint=move_6.Geometry)
lng = ListLength(List=beam_depth)
ln_5 = Line(StartPoint=move_4.Geometry, EndPoint=move_5.Geometry)
xy = XYPlane(Origin=move_5.Geometry)
X_4 = UnitX(Factor=expression_4)
move_7 = Move(Geometry=move.Geometry, Motion=X_4)  # -> Geometry, Transform
ln_6 = Line(StartPoint=move.Geometry, EndPoint=move_7.Geometry)
line = Line([ln_6, ln_2, ln_3, ln_4, ln])
lng_2 = ListLength(List=line)
division_2 = Division(A=lng_2, B=lng)
multiplication = Multiplication(A=lng, B=division_2)
repeat = RepeatData(Data=xy, Length=multiplication)
line_2 = Line(ln_5)
mirror = Mirror(Geometry=line, Plane=repeat)  # -> Geometry, Transform
mirror_2 = Mirror(Geometry=line_2, Plane=xy)  # -> Geometry, Transform
line_3 = Line([line_2, mirror_2.Geometry])
line_4 = Line([mirror.Geometry, line])
line_5 = Line(mirror.Geometry)
centerline = ClusterOutput(line_3)
back_line = ClusterOutput(line_4)

# ==== cluster Cluster
main_beam_depth = ClusterInput()
B = ClusterInput()
bar_diameter = ClusterInput()
G = ClusterInput()
sec_beam_width = ClusterInput()
subtraction = Subtraction(MainBeamDepth=main_beam_depth, BarOffset=B)
sec_beam_depth = ClusterInput()
multiplication = Multiplication(BarDiameter=bar_diameter, B=50)
pt = ClusterInput()
pt_2 = Point(pt)
division = Division(SecBeamWidth=sec_beam_width, B=2)
neg = Negative(SecBeamDepth=sec_beam_depth)
neg_2 = Negative(Value=subtraction)
Z = UnitZ(Factor=neg_2)
neg_3 = Negative(Value=division)
xz = XZPlane(Origin=pt_2)
dom = ConstructDomain(DomainStart=neg, DomainEnd=1)
dom_2 = ConstructDomain(DomainStart=neg_3, DomainEnd=division)
move = Move(Geometry=pt_2, Motion=Z)  # -> Geometry, Transform
addition = Addition(A=division, B=25)
rectangle = Rectangle(Plane=xz, XSize=dom_2, YSize=dom, Radius=0)  # -> Rectangle, Length
X = UnitX(Factor=addition)
rev = Reverse(Vector=X)
edges = BrepEdges(Brep=rectangle.Rectangle)  # -> Naked, Interior, NonManifold
move_2 = Move(Geometry=move.Geometry, Motion=X)  # -> Geometry, Transform
subtraction_2 = Subtraction(A=subtraction, B=B)
move_3 = Move(Geometry=move.Geometry, Motion=rev)  # -> Geometry, Transform
line = Line(edges.Naked)
ln = Line(StartPoint=move.Geometry, EndPoint=move_3.Geometry)
division_2 = Division(A=subtraction_2, B=2)
vec = VectorXYZ(XComponent=division_2, YComponent=0, ZComponent=subtraction_2)  # -> Vector, Length
neg_4 = Negative(Value=division_2)
move_4 = Move(Geometry=move_2.Geometry, Motion=vec.Vector)  # -> Geometry, Transform
ln_2 = Line(StartPoint=move.Geometry, EndPoint=move_2.Geometry)
vec_2 = VectorXYZ(XComponent=neg_4, YComponent=0, ZComponent=subtraction_2)  # -> Vector, Length
ln_3 = Line(StartPoint=move_2.Geometry, EndPoint=move_4.Geometry)
move_5 = Move(Geometry=move_3.Geometry, Motion=vec_2.Vector)  # -> Geometry, Transform
len = Length(Curve=ln_2)
ln_4 = Line(StartPoint=move_3.Geometry, EndPoint=move_5.Geometry)
len_2 = Length(Curve=ln_3)
item = ListItem(List=len, Index=0, Wrap=True)
item_2 = ListItem(List=len_2, Index=0, Wrap=True)
ma = MassAddition(Input=[item, item_2])  # -> Result, PartialResults
subtraction_3 = Subtraction(A=multiplication, B=ma.Result)
X_2 = UnitX(Factor=subtraction_3)
rev_2 = Reverse(Vector=X_2)
move_6 = Move(Geometry=move_5.Geometry, Motion=rev_2)  # -> Geometry, Transform
ln_5 = Line(StartPoint=move_5.Geometry, EndPoint=move_6.Geometry)
move_7 = Move(Geometry=move_4.Geometry, Motion=X_2)  # -> Geometry, Transform
ln_6 = Line(StartPoint=move_7.Geometry, EndPoint=move_4.Geometry)
geo = Geometry([ln_6, ln_3, ln_2, ln_5, ln_4, ln, line])
filter = StreamFilter(Gate=G, Stream1=geo)
s_0 = ClusterOutput(filter)

# ==== cluster Cluster_2
A = ClusterInput()
division = Division(A=A, B=1000)
cantilever = Number(division)
col_width = ClusterInput()
origin_point = ClusterInput()
beam_depth = ClusterInput()
rise = ClusterInput()
bool = ClusterInput()
col_width_2 = Number(col_width)

division_2 = Division(ColWidth=col_width_2, B2=2)
expression = Expression(x=cantilever, y=division_2, Expression="if (x  ≤y/1000, y/1000,x)")
multiplication = Multiplication(A=expression, B=1000)
subtraction = Subtraction(A=multiplication, ColWidth2=division_2)
neg = Negative(Value=subtraction)
X = UnitX(Factor=neg)

beam_depth_2 = Number(beam_depth)
panel = Panel(cantilever)
rise_2 = Number(rise)
bool_2 = Boolean(bool)
origin_point_2 = Point(origin_point)
panel_2 = Panel(expression)
if_cantilever = ClusterOutput(expression)
beam_depth_3 = Number(beam_depth_2)
Z = UnitZ(Factor=beam_depth_3)

col_width_3 = Number(col_width_2)
bool_3 = Boolean(bool_2)
expression_2 = Expression(x=col_width_3, y=bool_3, Expression="if(y=true, x/2-100, -x/2+100)")
X_2 = UnitX(Factor=expression_2)
Z_2 = UnitZ(Factor=rise_2)
move = Move(Geometry=origin_point_2, Motion=Z_2)  # -> Geometry, Transform
ln = Line(StartPoint=origin_point_2, EndPoint=move.Geometry)
move_2 = Move(Geometry=move.Geometry, Motion=X_2)  # -> Geometry, Transform
ln_2 = Line(StartPoint=move.Geometry, EndPoint=move_2.Geometry)
expression_3 = Expression(x=move_2.Geometry, y=bool_2, Expression="if(y=true, 100, -100)")
expression_4 = Expression(y=bool_2, Expression="if(y=true, -100, 100)")
X_3 = UnitX(Factor=expression_3)
move_3 = Move(Geometry=move_2.Geometry, Motion=X_3)  # -> Geometry, Transform
Z_3 = UnitZ(Factor=expression_4)
X_4 = UnitX(Factor=expression_4)
rev = Reverse(Vector=Z_3)
move_4 = Move(Geometry=move.Geometry, Motion=X_4)  # -> Geometry, Transform
move_5 = Move(Geometry=move_3.Geometry, Motion=rev)  # -> Geometry, Transform
ln_3 = Line(StartPoint=move_4.Geometry, EndPoint=move.Geometry)
ln_4 = Line(StartPoint=move_5.Geometry, EndPoint=move_2.Geometry)
ln_5 = Line(StartPoint=move_5.Geometry, EndPoint=move_3.Geometry)

move_6 = Move(Geometry=origin_point_2, Motion=Z)  # -> Geometry, Transform

expression_5 = Expression(x=col_width_2, y=bool_2, Expression="if(y=true, x/2, -x/2)")
division_3 = Division(A=beam_depth_2, B=2)
neg_2 = Negative(Value=rise_2)
X_5 = UnitX(Factor=expression_5)
addition = Addition(A=neg_2, B=division_3)
Z_4 = UnitZ(Factor=addition)
move_7 = Move(Geometry=move.Geometry, Motion=X_5)  # -> Geometry, Transform
move_8 = Move(Geometry=move_7.Geometry, Motion=Z_4)  # -> Geometry, Transform
xy = XYPlane(Origin=move_8.Geometry)
ln_6 = Line(StartPoint=move_7.Geometry, EndPoint=move_8.Geometry)

origin_point_3 = Point(simplify(origin_point_2))
expression_6 = Expression(Bool=bool_2, y=subtraction, Expression="if(Bool =True,-y,y)")
origin_point_4 = Point(simplify(move_6.Geometry))
expression_7 = Expression(Bool=bool_2, y=subtraction, Expression="if(Bool =True,-y,y)")
X_6 = UnitX(Factor=expression_6)
X_7 = UnitX(Factor=expression_7)
move_9 = Move(Geometry=origin_point_4, Motion=X_6)  # -> Geometry, Transform
move_10 = Move(Geometry=origin_point_3, Motion=X_7)  # -> Geometry, Transform
ln_7 = Line(StartPoint=origin_point_4, EndPoint=move_9.Geometry)
ln_8 = Line(StartPoint=origin_point_3, EndPoint=move_10.Geometry)
ln_9 = Line(StartPoint=move_9.Geometry, EndPoint=move_10.Geometry)
line = Line([ln_8, ln_9, ln_7])

ld_remain = ClusterOutput(subtraction)
origin_point_5 = ClusterOutput(origin_point_4)
origin_point_6 = ClusterOutput(origin_point_2)
G = ClusterOutput(move_10.Geometry)
G_2 = ClusterOutput(move_9.Geometry)

lng = ListLength(List=beam_depth_2)

line_2 = Line([ln_3, ln, ln_5, ln_2, ln_4])
line_3 = Line(ln_6)
mirror = Mirror(Geometry=line_3, Plane=xy)  # -> Geometry, Transform
line_4 = Line([line_3, mirror.Geometry])
centerline = ClusterOutput(line_4)

lng_2 = ListLength(List=line_2)
division_4 = Division(A=lng_2, B=lng)
multiplication_2 = Multiplication(A=lng, B=division_4)
repeat = RepeatData(Data=xy, Length=multiplication_2)

mirror_2 = Mirror(Geometry=line_2, Plane=repeat)  # -> Geometry, Transform
line_5 = Line([mirror_2.Geometry, line_2, line])
back_line = ClusterOutput(line_5)

# ==== cluster PositionText
beam_depth = ClusterInput()
col_width = ClusterInput()
bool = ClusterInput()
beam_depth_2 = Number(beam_depth)
col_width_2 = Number(col_width)
bool_2 = Boolean(bool)
location = Expression(x=bool_2, y=col_width_2, Expression="if ( x=true,y/2+50,-y/2-50)")
location_2 = Expression(x=bool_2, y=beam_depth_2, Expression="if ( x=true,-y-50,50)")
z_move = Number(location_2)
x_move = Number(location)
z_move_2 = ClusterOutput(z_move)
x_move_2 = ClusterOutput(x_move)

# ==== cluster HooksCL
longitudinal_bar_radius = ClusterInput()
shear_bar_dia = ClusterInput()
origin_pt = ClusterInput()
origin_pt_2 = Point(origin_pt)
expression = Expression(x=shear_bar_dia, y=longitudinal_bar_radius, Expression="10*x - y")
Z = UnitZ(Factor=longitudinal_bar_radius)
X = UnitX(Factor=expression)
move = Move(Geometry=origin_pt_2, Motion=Z)  # -> Geometry, Transform
move_2 = Move(Geometry=move.Geometry, Motion=X)  # -> Geometry, Transform
multiplication = Multiplication(A=longitudinal_bar_radius, B=2)
xz = XZPlane(Origin=origin_pt_2)
ln = Line(StartPoint=move.Geometry, EndPoint=move_2.Geometry)
Z_2 = UnitZ(Factor=multiplication)
expression_2 = Expression(Expression="-1* 30*π/180")
rev = Reverse(Vector=Z_2)
move_3 = Move(Geometry=ln, Motion=rev)  # -> Geometry, Transform
rotate = Rotate(Geometry=ln, Angle=expression_2, Plane=xz)  # -> Geometry, Transform
rotate_2 = Rotate(Geometry=move_3.Geometry, Angle=-0.785398, Plane=xz)  # -> Geometry, Transform
line = Line([rotate.Geometry, rotate_2.Geometry])
line_2 = ClusterOutput(line)

# ==== cluster Cluster_3
stirrup_diameter = ClusterInput()
beam_depth = ClusterInput()
beam_width_mm = ClusterInput()
slab_extension_mm = ClusterInput()
slab_depth_mm = ClusterInput()
cover = ClusterInput()
origin_point = ClusterInput()
long_bar_radius = ClusterInput()
stirrup_diameter_2 = Number(stirrup_diameter)
beam_depth_2 = Number(beam_depth)
beam_width_mm_2 = Number(beam_width_mm)
slab_extension_mm_2 = Number(slab_extension_mm)
slab_depth_mm_2 = Number(slab_depth_mm)
cover_2 = Number(cover)
origin_point_2 = Point(origin_point)
long_bar_radius_2 = Number(long_bar_radius)
stirrup_diameter_3 = ClusterOutput(stirrup_diameter_2)
beam_width_mm_3 = ClusterOutput(beam_width_mm_2)
long_bar_radius_3 = ClusterOutput(long_bar_radius_2)
Z = UnitZ(Factor=slab_depth_mm_2)
division = Division(A=beam_width_mm_2, B=2)
rev = Reverse(Vector=Z)
X = UnitX(Factor=division)
move = Move(Geometry=origin_point_2, Motion=rev)  # -> Geometry, Transform
rev_2 = Reverse(Vector=X)
move_2 = Move(Geometry=move.Geometry, Motion=X)  # -> Geometry, Transform
move_3 = Move(Geometry=move.Geometry, Motion=rev_2)  # -> Geometry, Transform
expression = Expression(x=beam_depth_2, y=slab_depth_mm_2, Expression="x-y")
expression_2 = Expression(x=beam_depth_2, y=slab_depth_mm_2, Expression="x-y")
X_2 = UnitX(Factor=slab_extension_mm_2)
X_3 = UnitX(Factor=slab_extension_mm_2)
Z_2 = UnitZ(Factor=expression)
Z_3 = UnitZ(Factor=expression_2)
Z_4 = UnitZ(Factor=slab_depth_mm_2)
move_4 = Move(Geometry=move_2.Geometry, Motion=X_2)  # -> Geometry, Transform
rev_3 = Reverse(Vector=X_3)
rev_4 = Reverse(Vector=Z_2)
rev_5 = Reverse(Vector=Z_3)
move_5 = Move(Geometry=move_2.Geometry, Motion=Z_4)  # -> Geometry, Transform
move_6 = Move(Geometry=move_3.Geometry, Motion=rev_3)  # -> Geometry, Transform
move_7 = Move(Geometry=move_2.Geometry, Motion=rev_4)  # -> Geometry, Transform
move_8 = Move(Geometry=move_3.Geometry, Motion=rev_5)  # -> Geometry, Transform
Z_5 = UnitZ(Factor=slab_depth_mm_2)
Z_6 = UnitZ(Factor=slab_depth_mm_2)
ln = Line(StartPoint=move_3.Geometry, EndPoint=move_8.Geometry)
move_9 = Move(Geometry=move_4.Geometry, Motion=Z_6)  # -> Geometry, Transform
move_10 = Move(Geometry=move_6.Geometry, Motion=Z_5)  # -> Geometry, Transform
ln_2 = Line(StartPoint=move_7.Geometry, EndPoint=move_8.Geometry)
ln_3 = Line(StartPoint=move_2.Geometry, EndPoint=move_4.Geometry)
ln_4 = Line(StartPoint=move_3.Geometry, EndPoint=move_6.Geometry)
ln_5 = Line(StartPoint=move_2.Geometry, EndPoint=move_7.Geometry)
ln_6 = Line(StartPoint=move_10.Geometry, EndPoint=move_9.Geometry)
beam_section_back_line = Line([ln_4, ln_6, ln, ln_3, ln_5, ln_2])
division_2 = Division(A=slab_depth_mm_2, B=Slider(5, range=0..10))
ln_7 = Line(StartPoint=move_6.Geometry, EndPoint=move_10.Geometry)
ln_8 = Line(StartPoint=move_4.Geometry, EndPoint=move_9.Geometry)
rec_3pt = Rectangle3Pt(PointA=move_5.Geometry, PointB=move_7.Geometry, PointC=move_8.Geometry)  # -> Rectangle, Length
midpt = CurveMiddle(Curve=ln_7)
multiplication = Multiplication(A=slab_depth_mm_2, B=Slider(2, range=0..10))
midpt_2 = CurveMiddle(Curve=ln_8)
beam_section_back_line_2 = ClusterOutput(beam_section_back_line)
xz = XZPlane(Origin=Point(0, 0, 0))
breakline = Breakline(num_2=division_2, pt=[midpt, midpt_2], num=multiplication, angle=Slider(90, range=0..100))
offset = OffsetCurve(Curve=rec_3pt.Rectangle, Distance=cover_2, Plane=xz, Corners=Slider(2, range=0..10))
breaklines = ClusterOutput(breakline)
stirrup_exterior = ClusterOutput(offset)

# ==== cluster DimensionVertical
dimension_offset = ClusterInput()
second_pt = ClusterInput()
first_pt = ClusterInput()
txt = ClusterInput()
dimension_offset_2 = Number(dimension_offset)
second_pt_2 = Point(second_pt)
first_pt_2 = Point(first_pt)
txt_2 = Text(txt)
ln = Line(StartPoint=first_pt_2, EndPoint=second_pt_2)
curvepoint = PointOnCurve(ln, parameter=0.5)
expression = Expression(Expression="90*π/180")
xz = XZPlane(Origin=curvepoint)
rotate = Rotate(Geometry=ln, Angle=expression, Plane=xz)  # -> Geometry, Transform
curvepoint_2 = PointOnCurve(rotate.Geometry, parameter=0)
curvepoint_3 = PointOnCurve(rotate.Geometry, parameter=1)
lineardim = DefineLinearDimension(Point1=curvepoint_2, Point2=curvepoint_3, DimensionPlane=xz, Offset=dimension_offset_2, DimensionStyle=txt_2)
rotate_2 = Rotate(Geometry=lineardim, Angle=expression, Plane=xz)  # -> Geometry, Transform
G = ClusterOutput(rotate_2.Geometry)

# ==== cluster Breakline
num = ClusterInput()
angle = ClusterInput()
num_2 = ClusterInput()
num_3 = Number(num)
angle_2 = Number(angle)
pt = ClusterInput()
num_4 = Number(num_2)
division = Division(A=num_3, B=2)
expression = Expression(x=angle_2, Expression="x*π/180")
pt_2 = Point(pt)
X = UnitX(Factor=division)
rev = Reverse(Vector=X)
neg = Negative(Value=num_4)
X_2 = UnitX(Factor=neg)
move = Move(Geometry=pt_2, Motion=rev)  # -> Geometry, Transform
move_2 = Move(Geometry=pt_2, Motion=X_2)  # -> Geometry, Transform
Z = UnitZ(Factor=num_4)
move_3 = Move(Geometry=pt_2, Motion=X)  # -> Geometry, Transform
X_3 = UnitX(Factor=num_4)
move_4 = Move(Geometry=move_2.Geometry, Motion=Z)  # -> Geometry, Transform
move_5 = Move(Geometry=pt_2, Motion=X_3)  # -> Geometry, Transform
neg_2 = Negative(Value=num_4)
ln = Line(StartPoint=move_2.Geometry, EndPoint=move.Geometry)
ln_2 = Line(StartPoint=move_4.Geometry, EndPoint=move_2.Geometry)
Z_2 = UnitZ(Factor=neg_2)
xz = XZPlane(Origin=pt_2)
move_6 = Move(Geometry=move_5.Geometry, Motion=Z_2)  # -> Geometry, Transform
ln_3 = Line(StartPoint=move_5.Geometry, EndPoint=move_3.Geometry)
ln_4 = Line(StartPoint=move_5.Geometry, EndPoint=move_6.Geometry)
ln_5 = Line(StartPoint=move_4.Geometry, EndPoint=move_6.Geometry)
line = Line([ln_2, ln_4, ln_5, ln_3, ln])
join = JoinCurves(Curves=line, Preserve=False)
rotate = Rotate(Geometry=join, Angle=expression, Plane=xz)  # -> Geometry, Transform
G = ClusterOutput(rotate.Geometry)
